# Dynamo graph VSCode.dyn (Dynamo 2.10.1.3976)
# packages: Crumple 2022.5.27, LinkDWG2 0.4.18, Synthesize toolkit 6.7.9

boolean = BoolSelector(true)  # frozen
file_path = Filename(".\OKB01.py")
python_script = Python(IN[0]=boolean, IN[1]=file_path)  # IronPython2
# ---------- python_script.python (5 lines) ----------
re  = open(r"C:\Users\Desktop\Python\02_PyRevit\04_Processing\01_pyRevitAPI\02_Processing\OKB01.py", "r")

interpret = re.read()

OUT =  interpret
# ----------------------------------------
python_script_from_string = PythonStringNode(script=python_script)  # IronPython2; unwired: IN[0], IN[1]
code_block = CodeBlock(a=python_script_from_string) { a[0]; }
code_block_2 = CodeBlock(a=python_script_from_string) { a[1]; }
code_block_3 = CodeBlock(a=python_script_from_string) { a[2]; }
code_block_4 = CodeBlock(a=python_script_from_string) { a[3]; }
code_block_5 = CodeBlock(a=python_script_from_string) { a[5]; }
code_block_6 = CodeBlock(a=python_script_from_string) { a[4]; }
code_block_7 = CodeBlock(a=python_script_from_string) { a[6]; }
code_block_8 = CodeBlock(a=python_script_from_string) { a[7]; }
excel_import = Custom[© Excel.Import+]()  # frozen; package Crumple; ImportExcel, with a few extra settings for quicker importing.; unwired: filePath
boolean_2 = BoolSelector(false)  # frozen
file_path_2 = Filename(".\SOJ_MTO Length.py")
python_script_2 = Python(IN[0]=boolean_2, IN[1]=file_path_2)  # IronPython2
# ---------- python_script_2.python (5 lines) ----------
re  = open(r"C:\Users\Desktop\Python\02_PyRevit\04_Processing\RevitAPI\01_pyRevitAPI\02_Processing\SOJ_MTO Length.py", "r")

interpret = re.read()

OUT =  interpret
# ----------------------------------------
python_script_from_string_2 = PythonStringNode(script=python_script_2)  # IronPython2; unwired: IN[0], IN[1]
boolean_3 = BoolSelector(true)
file_path_3 = Filename(".\filterByPipingSystemInActiveView.py")
python_script_3 = Python(IN[0]=boolean_3, IN[1]=file_path_3)  # IronPython2
# ---------- python_script_3.python (5 lines) ----------
re  = open(r"C:\Users\Desktop\Python\02_PyRevit\04_Processing\RevitAPI\01_pyRevitAPI\02_Processing\filterByPipingSystemInActiveView.py", "r")

interpret = re.read()

OUT =  interpret
# ----------------------------------------
code_block_9 = CodeBlock { "PS-XX-OXYGEN"; "PS-XX-OXYGEN+NITROGEN"; }
python_script_from_string_3 = PythonStringNode(script=python_script_3, IN[0]=code_block_9.out1)  # IronPython2; frozen; unwired: IN[1]
boolean_4 = BoolSelector(true)
file_path_4 = Filename(".\setPipeSystem.py")
python_script_4 = Python(IN[0]=boolean_4, IN[1]=file_path_4)  # IronPython2
# ---------- python_script_4.python (5 lines) ----------
re  = open(r"C:\Users\Desktop\Python\02_PyRevit\04_Processing\RevitAPI\01_pyRevitAPI\02_Processing\setPipeSystem.py", "r")

interpret = re.read()

OUT =  interpret
# ----------------------------------------
python_script_from_string_4 = PythonStringNode(script=python_script_4)  # IronPython2; frozen; unwired: IN[0]
boolean_5 = BoolSelector(true)  # frozen
file_path_5 = Filename("..\..\..\..\..\..\NSY01\NSY01_240717\【作業中・検討用】C-115,116_排水池上澄水管_更新配管図240712(４・５号弁室修正).dwg")
python_script_5 = Python(IN[0]=boolean_5, IN[1]=file_path_5)  # IronPython2
# ---------- python_script_5.python (5 lines) ----------
re  = open(r"C:\Users\Desktop\Python\02_PyRevit\04_Processing\RevitAPI\01_pyRevitAPI\02_Processing\linkCadToSectionView_241221.py", "r")

interpret = re.read()

OUT =  interpret
# ----------------------------------------
python_script_from_string_5 = PythonStringNode(script=python_script_5)  # IronPython2; unwired: IN[0]
DWGFilepath = Custom[DWGFilepath]()  # frozen; package LinkDWG2; Get the full path and name of the linked (not imported) importInstance; unwired: LinkedOnlyImportInstance
filePath = Custom[RH.FilePath]()  # frozen; package Synthesize toolkit; Provides a file path option for use with Dynamo Player.
