# Dynamo graph splitPipe.dyn (Dynamo 2.10.1.3976)

boolean = BoolSelector(false)
file_path = Filename(".\splitPipe.py")
python_script = Python(IN[0]=boolean, IN[1]=file_path)  # IronPython2
# ---------- python_script.python (5 lines) ----------
re  = open(r"C:\Users\Desktop\Python\02_PyRevit\04_Processing\01_pyRevitAPI\splitPipe.py", "r")

interpret = re.read()

OUT =  interpret
# ----------------------------------------
python_script_from_string = PythonStringNode(script=python_script)  # IronPython2
