# Dynamo graph Template.dyn (Dynamo 2.10.1.3976)
# packages: Duynamo 2022.12.24, BIM3DM 2.1.9, BIM3DM 2.1.22

# group: Select Model Elements
boolean = BoolSelector(true)
select_model_elements = Python(IN[0]=boolean)  # IronPython2; frozen
# ---------- select_model_elements.python (28 lines) ----------
import clr 
clr.AddReference("RevitAPI")
import Autodesk
from Autodesk.Revit.DB import *

clr.AddReference("RevitServices")
import RevitServices
from RevitServices.Persistence import DocumentManager

clr.AddReference("RevitAPIUI")
from Autodesk.Revit.UI import *

clr.AddReference("RevitNodes")
import Revit
clr.ImportExtensions(Revit.Elements)

doc = DocumentManager.Instance.CurrentDBDocument
uidoc=DocumentManager.Instance.CurrentUIApplication.ActiveUIDocument

obType = Selection.ObjectType.Element
ref =  uidoc.Selection.PickObjects(obType, "Please select model elements")

result = []
for ele in ref:
    elementsID = doc.GetElement(ele.ElementId)
    result.Add(elementsID.ToDSType)

OUT = result
# ----------------------------------------

# group: Select Model Element
boolean_2 = BoolSelector(true)
select_model_element = Python(IN[0]=boolean_2)  # IronPython2; frozen
# ---------- select_model_element.python (26 lines) ----------
import clr 
clr.AddReference("RevitAPI")
import Autodesk
from Autodesk.Revit.DB import *

clr.AddReference("RevitServices")
import RevitServices
from RevitServices.Persistence import DocumentManager

clr.AddReference("RevitAPIUI")
from Autodesk.Revit.UI import *

clr.AddReference("RevitNodes")
import Revit
clr.ImportExtensions(Revit.Elements)

doc = DocumentManager.Instance.CurrentDBDocument
uidoc=DocumentManager.Instance.CurrentUIApplication.ActiveUIDocument

obType = Selection.ObjectType.Element
ref =  uidoc.Selection.PickObject(obType, "Please select model element")

elementID = doc.GetElement(ref.ElementId)
element = elementID.ToDSType

OUT = element
# ----------------------------------------

# group: Get one Face and Line
boolean_3 = BoolSelector(true)
select_model_element_2 = Python(IN[0]=boolean_3)  # IronPython2; frozen
# ---------- select_model_element_2.python (38 lines) ----------
import clr 
import sys

import math
from System.Collections.Generic import *

clr.AddReference("ProtoGeometry")
from Autodesk.DesignScript.Geometry import *

clr.AddReference("RevitAPI")
import Autodesk
from Autodesk.Revit.DB import *

clr.AddReference("RevitAPIUI")
from Autodesk.Revit.UI import *
from Autodesk.Revit.UI.Selection import *

clr.AddReference("RevitNodes")
import Revit
clr.ImportExtensions(Revit.Elements)
clr.ImportExtensions(Revit.GeometryConversion)

clr.AddReference("RevitServices")
import RevitServices
from RevitServices.Persistence import DocumentManager
from RevitServices.Transactions import TransactionManager

doc = DocumentManager.Instance.CurrentDBDocument
view = doc.ActiveView
uidoc=DocumentManager.Instance.CurrentUIApplication.ActiveUIDocument

ref = uidoc.Selection.PickObject(ObjectType.Face, "Select One Face")
ele = uidoc.Document.GetElement(ref.ElementId)
retriEle = ele.GetGeometryObjectFromReference(ref)
getSurface = retriEle.ToProtoType()
getSurCuver = retriEle.GetEdgesAsCurveLoops()

OUT = getSurCuver
# ----------------------------------------
toprototype__level3 = Python(IN[1]=select_model_element_2)  # IronPython2; unwired: IN[0]
# ---------- toprototype__level3.python (34 lines) ----------
import clr 
import sys

import math
from System.Collections.Generic import *

clr.AddReference("ProtoGeometry")
from Autodesk.DesignScript.Geometry import *

clr.AddReference("RevitAPI")
import Autodesk
from Autodesk.Revit.DB import *

clr.AddReference("RevitAPIUI")
from Autodesk.Revit.UI import *
from Autodesk.Revit.UI.Selection import *

clr.AddReference("RevitNodes")
import Revit
clr.ImportExtensions(Revit.Elements)
clr.ImportExtensions(Revit.GeometryConversion)

clr.AddReference("RevitServices")
import RevitServices
from RevitServices.Persistence import DocumentManager
from RevitServices.Transactions import TransactionManager

element = UnwrapElement(IN[0])

doc = DocumentManager.Instance.CurrentDBDocument
view = doc.ActiveView
uidoc=DocumentManager.Instance.CurrentUIApplication.ActiveUIDocument

OUT = [j.ToProtoType() for i in IN[1] for j in i]
# ----------------------------------------

# group: Get Multi Face and Bounding line
boolean_4 = BoolSelector(true)
select_model_element_3 = Python(IN[0]=boolean_4)  # IronPython2; frozen
# ---------- select_model_element_3.python (41 lines) ----------
import clr 
import sys

import math
from System.Collections.Generic import *

clr.AddReference("ProtoGeometry")
from Autodesk.DesignScript.Geometry import *

clr.AddReference("RevitAPI")
import Autodesk
from Autodesk.Revit.DB import *

clr.AddReference("RevitAPIUI")
from Autodesk.Revit.UI import *
from Autodesk.Revit.UI.Selection import *

clr.AddReference("RevitNodes")
import Revit
clr.ImportExtensions(Revit.Elements)
clr.ImportExtensions(Revit.GeometryConversion)

clr.AddReference("RevitServices")
import RevitServices
from RevitServices.Persistence import DocumentManager
from RevitServices.Transactions import TransactionManager

doc = DocumentManager.Instance.CurrentDBDocument
view = doc.ActiveView
uidoc=DocumentManager.Instance.CurrentUIApplication.ActiveUIDocument

ref = uidoc.Selection.PickObjects(ObjectType.Face, "Select Multi Face")
result = []

for i in ref :
	ele = uidoc.Document.GetElement(i.ElementId)
	retriEle = ele.GetGeometryObjectFromReference(i)
	getSurface = retriEle.ToProtoType()
	getSurCuver = retriEle.GetEdgesAsCurveLoops()
	result.append(getSurCuver)
OUT = result
# ----------------------------------------
toprototype__level3_2 = Python(IN[1]=select_model_element_3)  # IronPython2; unwired: IN[0]
# ---------- toprototype__level3_2.python (34 lines) ----------
import clr 
import sys

import math
from System.Collections.Generic import *

clr.AddReference("ProtoGeometry")
from Autodesk.DesignScript.Geometry import *

clr.AddReference("RevitAPI")
import Autodesk
from Autodesk.Revit.DB import *

clr.AddReference("RevitAPIUI")
from Autodesk.Revit.UI import *
from Autodesk.Revit.UI.Selection import *

clr.AddReference("RevitNodes")
import Revit
clr.ImportExtensions(Revit.Elements)
clr.ImportExtensions(Revit.GeometryConversion)

clr.AddReference("RevitServices")
import RevitServices
from RevitServices.Persistence import DocumentManager
from RevitServices.Transactions import TransactionManager

element = UnwrapElement(IN[0])

doc = DocumentManager.Instance.CurrentDBDocument
view = doc.ActiveView
uidoc=DocumentManager.Instance.CurrentUIApplication.ActiveUIDocument

OUT = [k.ToProtoType() for i in IN[1] for j in i for k in j]
# ----------------------------------------

# group: Get Multi Face and Bounding line
boolean_5 = BoolSelector(false)
select_model_element_4 = Python(IN[0]=boolean_5)  # IronPython2; frozen
# ---------- select_model_element_4.python (64 lines) ----------
import clr 
import sys

import math
from System.Collections.Generic import *

clr.AddReference("ProtoGeometry")
from Autodesk.DesignScript.Geometry import *

clr.AddReference("RevitAPI")
import Autodesk
from Autodesk.Revit.DB import *

clr.AddReference("RevitAPIUI")
from Autodesk.Revit.UI import *
from Autodesk.Revit.UI.Selection import *

clr.AddReference("RevitNodes")
import Revit
clr.ImportExtensions(Revit.Elements)
clr.ImportExtensions(Revit.GeometryConversion)

clr.AddReference("RevitServices")
import RevitServices
from RevitServices.Persistence import DocumentManager
from RevitServices.Transactions import TransactionManager

doc = DocumentManager.Instance.CurrentDBDocument
view = doc.ActiveView
uidoc=DocumentManager.Instance.CurrentUIApplication.ActiveUIDocument


def getGeoElement(element): # Get geometry of element.
    geo = []
    opt = Options()
    geoByElement = element.get_Geometry(opt)
    geoEnum = geoByElement.GetEnumerator()
    geoEnum.MoveNext()
    geoNext = geoEnum.Current.GetInstanceGeometry()
    geo = [i for i in geoNext]
    out = []
    for i in geo:
    	if i.GetType()== Solid and i.Volume > 0:	
    		out.append(i)	
		if i.GetType() == GeometryInstance:	
			var = i.SymbolGeometry
			for j in var:
				if j.Volume > 0:
					out.append(i)
    return out


ref = uidoc.Selection.PickObjects(ObjectType.Face, "Select Multi Face")
result = []
lst = []

for i in ref :
	ele = uidoc.Document.GetElement(i.ElementId)
	geoFraming = getGeoElement(ele)

	result.append(geoFraming)
	

OUT = result
# ----------------------------------------

# group: IF by code block
code_block = CodeBlock()
# ---------- code_block.designscript (14 lines) ----------
def testIF(test, iftrue:var[]..[],iffalse:var[]..[])
{
return = [Imperative]
{
if(test)
{
return = iftrue;
}
else
{
return = iffalse;
}
}
};
# ----------------------------------------
code_block_2 = CodeBlock { testIF(test,iftrue,iffalse); }  # unwired: test, iftrue, iffalse

code_block_3 = CodeBlock { 0; }
if_code_block = CodeBlock(women=code_block_3)
# ---------- if_code_block.designscript (3 lines) ----------
(women==0)?0:
(women<=40?1:(women<=70?3:
(women<=100?4:(Maths.Round(((women-100)/40)+4)))));
# ----------------------------------------

# group: waitFor
wait_for = CodeBlock { [WaitFor,Pass][1]; }  # unwired: WaitFor, Pass

code_block_4 = CodeBlock { (10..200..20); }

# group: List Flatten
code_block_5 = CodeBlock { lst = [[1,2],[22,55],[111111,2,3,45,6,7,8]]; }
code_block_6 = CodeBlock(a=code_block_5) { a; }
code_block_7 = CodeBlock(x=code_block_6) { List.Flatten(x); }
flatten_by_import_dscorenodes = Python(IN[0]=code_block_5)  # "Flatten by import DSCoreNodes class"; IronPython2
# ---------- flatten_by_import_dscorenodes.python (46 lines) ----------
"""Copyright by: vudinhduybm@gmail.com"""
import clr 
import System
import math 
from System.Collections.Generic import *

clr.AddReference("ProtoGeometry")
from Autodesk.DesignScript.Geometry import *

clr.AddReference('RevitAPI')
import Autodesk
from Autodesk.Revit.DB import *

clr.AddReference('RevitAPIUI')
from Autodesk.Revit.UI import*
from  Autodesk.Revit.UI.Selection import*

clr.AddReference("RevitNodes")
import Revit
clr.ImportExtensions(Revit.Elements)
clr.ImportExtensions(Revit.GeometryConversion)

clr.AddReference("RevitServices")
import RevitServices
from RevitServices.Persistence import DocumentManager
from RevitServices.Transactions import TransactionManager

clr.AddReference("DSCoreNodes")
from DSCore.List import Flatten

doc = DocumentManager.Instance.CurrentDBDocument
view = doc.ActiveView
uidoc = DocumentManager.Instance.CurrentUIApplication.ActiveUIDocument

#Preparing input from dynamo to revit
element = UnwrapElement(IN[0])

#Do some action in a Transaction
TransactionManager.Instance.EnsureInTransaction(doc)
"""Now, You Can Code """



TransactionManager.Instance.TransactionTaskDone()

OUT = Flatten(IN[0])
# ----------------------------------------
flatten_by_hasattr_and = Python(IN[0]=code_block_5)  # "Flatten by hasattr and isinstance function"; IronPython2
# ---------- flatten_by_hasattr_and.python (51 lines) ----------
"""Copyright by: vudinhduybm@gmail.com"""
import clr 
import System
import math 
from System.Collections.Generic import *

clr.AddReference("ProtoGeometry")
from Autodesk.DesignScript.Geometry import *

clr.AddReference('RevitAPI')
import Autodesk
from Autodesk.Revit.DB import *

clr.AddReference('RevitAPIUI')
from Autodesk.Revit.UI import*
from  Autodesk.Revit.UI.Selection import*

clr.AddReference("RevitNodes")
import Revit
clr.ImportExtensions(Revit.Elements)
clr.ImportExtensions(Revit.GeometryConversion)

clr.AddReference("RevitServices")
import RevitServices
from RevitServices.Persistence import DocumentManager
from RevitServices.Transactions import TransactionManager

doc = DocumentManager.Instance.CurrentDBDocument
view = doc.ActiveView
uidoc = DocumentManager.Instance.CurrentUIApplication.ActiveUIDocument

#Preparing input from dynamo to revit
element = UnwrapElement(IN[0])

#Do some action in a Transaction
TransactionManager.Instance.EnsureInTransaction(doc)
"""Now, You Can Code """
def flatten(x):
    result = []
    try:
    	for el in x:
        	if hasattr(el, "__iter__") and not isinstance(el, basestring):
        	    result.extend(flatten(el))
        	else:
        	    result.append(el)
    except:
    	result = x
    return result

TransactionManager.Instance.TransactionTaskDone()
OUT = flatten(IN[0])
# ----------------------------------------
flatten_by_import_collections = Python(IN[0]=code_block_5)  # "Flatten by import collections class"; IronPython2
# ---------- flatten_by_import_collections.python (48 lines) ----------
"""Copyright by: vudinhduybm@gmail.com"""
import clr 
import System
import math 
from System.Collections.Generic import *

clr.AddReference("ProtoGeometry")
from Autodesk.DesignScript.Geometry import *

clr.AddReference('RevitAPI')
import Autodesk
from Autodesk.Revit.DB import *

clr.AddReference('RevitAPIUI')
from Autodesk.Revit.UI import*
from  Autodesk.Revit.UI.Selection import*

clr.AddReference("RevitNodes")
import Revit
clr.ImportExtensions(Revit.Elements)
clr.ImportExtensions(Revit.GeometryConversion)

clr.AddReference("RevitServices")
import RevitServices
from RevitServices.Persistence import DocumentManager
from RevitServices.Transactions import TransactionManager

import collections

doc = DocumentManager.Instance.CurrentDBDocument
view = doc.ActiveView
uidoc = DocumentManager.Instance.CurrentUIApplication.ActiveUIDocument

#Preparing input from dynamo to revit
element = UnwrapElement(IN[0])

#Do some action in a Transaction
TransactionManager.Instance.EnsureInTransaction(doc)
"""Now, You Can Code """

def flattenList(unflattened_list):
	if isinstance(unflattened_list,collections.Iterable):
		return [sub_element for element in unflattened_list for sub_element in flattenList(element)]
	else:
		return [unflattened_list]

TransactionManager.Instance.TransactionTaskDone()
OUT = flattenList(IN[0])
# ----------------------------------------

# group: Get Multi Face and Bounding line
boolean_6 = BoolSelector(false)
select_model_element_5 = Python(IN[0]=boolean_6)  # IronPython2; frozen
# ---------- select_model_element_5.python (87 lines) ----------
import clr 
import sys

import math
from System.Collections.Generic import *

clr.AddReference("ProtoGeometry")
from Autodesk.DesignScript.Geometry import *

clr.AddReference("RevitAPI")
import Autodesk
from Autodesk.Revit.DB import *

clr.AddReference("RevitAPIUI")
from Autodesk.Revit.UI import *
from Autodesk.Revit.UI.Selection import *

clr.AddReference("RevitNodes")
import Revit
clr.ImportExtensions(Revit.Elements)
clr.ImportExtensions(Revit.GeometryConversion)

clr.AddReference("RevitServices")
import RevitServices
from RevitServices.Persistence import DocumentManager
from RevitServices.Transactions import TransactionManager

doc = DocumentManager.Instance.CurrentDBDocument
view = doc.ActiveView
uidoc=DocumentManager.Instance.CurrentUIApplication.ActiveUIDocument


def getGeoElement(element): # Get geometry of element.
    geo = []
    opt = Options()
    geoByElement = element.get_Geometry(opt)
    geoEnum = geoByElement.GetEnumerator()
    geoEnum.MoveNext()
    geoNext = geoEnum.Current.GetInstanceGeometry()
    geo = [i for i in geoNext]
    out = []
    for i in geo:
    	if i.GetType()== Solid and i.Volume > 0:	
    		out.append(i)	
		if i.GetType() == GeometryInstance:	
			var = i.SymbolGeometry
			for j in var:
				if j.Volume > 0:
					out.append(i)
    return out

def getDBSolidFromGeo(lstGeo): # Get Solid from Geo
    sol = []
    for i in lstGeo:
        if type(i)== Autodesk.Revit.DB.Solid and i.Volume > 0:
            sol.append(i)
        elif type(i)== Autodesk.Revit.DB.GeometryInstance:
            var = i.SymbolGeometry
            for j in var:
                if type(j)== Autodesk.Revit.DB.Solid and j.Volume > 0:
                    sol.append(j)
        	sol.append(j)
    return sol
	
def getDBPlanarFormSolid(solids): # Get Planarface from solids
    plaf = []
    for i in solids:
        var = i.Faces
        for j in var:
            if j.Reference != None:
                plaf.append(j)
    return plaf

ref = uidoc.Selection.PickObjects(ObjectType.Face, "Select Multi Face")
result = []
lst = []

for i in ref :
	ele = uidoc.Document.GetElement(i.ElementId)
	getGeoFraming=[getGeoElement(ele) for i in ref]
	for j in getGeoFraming:
		getSolid = [getDBSolidFromGeo(j) for j in getGeoFraming]
		for t in getSolid:
			getPlane = [getDBPlanarFormSolid(t) for t in getSolid]
			result.append(getPlane)
	
OUT = result
# ----------------------------------------
toprototype__level3_3 = Python(IN[1]=select_model_element_5)  # IronPython2; unwired: IN[0]; same code as toprototype__level3_2

code_block_8 = CodeBlock { 100; 200; 0; 1; }
code_block_9 = CodeBlock(a=code_block_8.out0, b=code_block_8.out1) { a>b; }
logicIf = Custom[logicIf](Test=code_block_9, ifTrue=code_block_8.out3, ifFalse=code_block_8.out2)  # package Duynamo
code_block_10 = CodeBlock(a=logicIf) { a; }
boolean_7 = BoolSelector(true)
pickObjects = Custom[pickObjects](Reset=boolean_7)  # frozen; package Duynamo; from Duynamo to pick Objects
getElementsDBSolid = Custom[getElementsDBSolid](element=pickObjects.eleList)  # package Duynamo; from Duynamo to retrive DBSolid of elements
getPlanarFromSolid = Custom[getPlanarFromSolid](DBSolid=getElementsDBSolid)  # package Duynamo; from Duynamo retrive Elements DBPlanar from DBSolid
conversionRtD = Custom[ConversionRtD](Objects=getPlanarFromSolid@L2)  # package BIM3DM; Return an object entity that can be displayed on the Dynamo interface.
flattenToLevel = Custom[FlattenToLevel](inputList=conversionRtD)  # package Duynamo; from Duynamo to Flatten input List to expected Level
boolean_8 = BoolSelector(false)  # frozen
pickMultiFaces = Custom[pickMultiFaces](Reset=boolean_8)  # package Duynamo; from Duynamo to select multi Faces
code_block_11 = CodeBlock(a=pickMultiFaces.element) { a; }
code_block_12 = CodeBlock { a[0]; a[1]; a[2]; }  # unwired: a
code_block_13 = CodeBlock(x=code_block_12.out1) { x; }
code_block_14 = CodeBlock(DynamoXYZ=code_block_12.out0) { DynamoXYZ; }
code_block_15 = CodeBlock(revitPointsInMillimeterUnit=code_block_12.out1) { revitPointsInMillimeterUnit; }
code_block_16 = CodeBlock(x=code_block_12.out2) { x; }
code_block_17 = CodeBlock()
# ---------- code_block_17.designscript (2 lines) ----------
//String Input Req
"Please pick points";
# ----------------------------------------
code_block_18 = CodeBlock { Reset: bool = false; }

# group: pick Points
boolean_9 = BoolSelector(true)  # frozen
pickPoints = Custom[pickPoints](Reset=boolean_9)  # package Duynamo; from Duynamo. pick Point in current Workplane and retrive Revit Points in Millimeter unit
code_block_19 = CodeBlock(a=pickPoints.revitPointsInMillimeterUnit) { a; }

boolean_10 = BoolSelector(true)  # frozen
pickFaces = Python(IN[0]=boolean_10)  # IronPython2
# ---------- pickFaces.python (47 lines) ----------
"""Copyright by: vudinhduybm@gmail.com"""
import clr 
import System
import math 
from System.Collections.Generic import *

clr.AddReference("ProtoGeometry")
from Autodesk.DesignScript.Geometry import *

clr.AddReference('RevitAPI')
import Autodesk
from Autodesk.Revit.DB import *

clr.AddReference('RevitAPIUI')
from Autodesk.Revit.UI import*
from  Autodesk.Revit.UI.Selection import*

clr.AddReference("RevitNodes")
import Revit
clr.ImportExtensions(Revit.Elements)
clr.ImportExtensions(Revit.GeometryConversion)

clr.AddReference("RevitServices")
import RevitServices
from RevitServices.Persistence import DocumentManager
from RevitServices.Transactions import TransactionManager

doc = DocumentManager.Instance.CurrentDBDocument
view = doc.ActiveView
uidoc = DocumentManager.Instance.CurrentUIApplication.ActiveUIDocument

def pickObjects():
    faces = []
    elements = []
    opt = Options()
    opt.ComputeReferences = True
    refs = uidoc.Selection.PickObjects(Autodesk.Revit.UI.Selection.ObjectType.Face, "Please select the Desired Faces")
    #GeoObs = doc.GetElement(refs).GetGeometryObjectFromReference(refs)
    for i in refs:
        ele = doc.GetElement(i.ElementId)
        elements.append(ele)
        face = ele.GetGeometryObjectFromReference(i )
        faces.append(face.ToProtoType())
        
    return  faces, elements

OUT = pickObjects()
# ----------------------------------------
code_block_20 = CodeBlock(a=pickFaces) { a[1]; }
getElementsDBSolid_2 = Custom[getElementsDBSolid](element=code_block_20)
getPlanarFromSolid_2 = Custom[getPlanarFromSolid](DBSolid=getElementsDBSolid_2)
conversionRtD_2 = Custom[ConversionRtD](Objects=getPlanarFromSolid_2@L2)
code_block_21 = CodeBlock { 2; }
flattenToLevel_2 = Custom[FlattenToLevel](inputList=conversionRtD_2, level=code_block_21)
pickEdges = Python()  # IronPython2; frozen; unwired: IN[0]
# ---------- pickEdges.python (41 lines) ----------
"""Copyright by: vudinhduybm@gmail.com"""
import clr 
import System
import math 
from System.Collections.Generic import *

clr.AddReference("ProtoGeometry")
from Autodesk.DesignScript.Geometry import *

clr.AddReference('RevitAPI')
import Autodesk
from Autodesk.Revit.DB import *

clr.AddReference('RevitAPIUI')
from Autodesk.Revit.UI import*
from  Autodesk.Revit.UI.Selection import*
from Autodesk.Revit.UI.Selection import ObjectType

clr.AddReference("RevitNodes")
import Revit
clr.ImportExtensions(Revit.Elements)
clr.ImportExtensions(Revit.GeometryConversion)

clr.AddReference("RevitServices")
import RevitServices
from RevitServices.Persistence import DocumentManager
from RevitServices.Transactions import TransactionManager

doc = DocumentManager.Instance.CurrentDBDocument
view = doc.ActiveView
uidoc = DocumentManager.Instance.CurrentUIApplication.ActiveUIDocument

def pickObjects():
    elements = []
    refs = uidoc.Selection.PickObjects(Autodesk.Revit.UI.Selection.ObjectType.Edge, "Please select the Desired Edges")
    for i in refs:
        ele = doc.GetElement(i.ElementId)
        elements.append(ele)
    return  refs, elements

OUT = pickObjects()
# ----------------------------------------
pickMultiFaces_2 = Custom[pickMultiFaces]()  # frozen
code_block_22 = CodeBlock(a=pickMultiFaces_2.element) { a; }
code_block_23 = CodeBlock(a=pickFaces) { a[0]; }
flatten = List.Flatten(list=code_block_23)
code_block_24 = CodeBlock { a; }  # unwired: a
pickEdges_2 = Custom[pickEdges]()  # frozen; package Duynamo; from Duynamo to select desired Edges
code_block_25 = CodeBlock(a=pickEdges_2.reference) { a; }
pickFaces_2 = Python()  # IronPython2; frozen; unwired: IN[0]
# ---------- pickFaces_2.python (37 lines) ----------
"""Copyright by: vudinhduybm@gmail.com"""
import clr 
import System
import math 
from System.Collections.Generic import *

clr.AddReference("ProtoGeometry")
from Autodesk.DesignScript.Geometry import *

clr.AddReference('RevitAPI')
import Autodesk
from Autodesk.Revit.DB import *

clr.AddReference('RevitAPIUI')
from Autodesk.Revit.UI import*
from  Autodesk.Revit.UI.Selection import*

clr.AddReference("RevitNodes")
import Revit
clr.ImportExtensions(Revit.Elements)
clr.ImportExtensions(Revit.GeometryConversion)

clr.AddReference("RevitServices")
import RevitServices
from RevitServices.Persistence import DocumentManager
from RevitServices.Transactions import TransactionManager

doc = DocumentManager.Instance.CurrentDBDocument
view = doc.ActiveView
uidoc = DocumentManager.Instance.CurrentUIApplication.ActiveUIDocument

def pickObjects():
    from Autodesk.Revit.UI.Selection import ObjectType
    refs = uidoc.Selection.PickObjects(ObjectType.Face, "Please select the Desired Faces")
    return  [doc.GetElement(i.ElementId) for i in refs], [ref for ref in refs]

OUT = pickObjects()
# ----------------------------------------
code_block_26 = CodeBlock(a=pickFaces_2) { a[1]; }
code_block_27 = CodeBlock(a=pickEdges_2.element) { a; }
boolean_11 = BoolSelector(true)  # frozen
pickEdges1 = Python(IN[0]=boolean_11)  # IronPython2
# ---------- pickEdges1.python (45 lines) ----------
"""Copyright by: vudinhduybm@gmail.com"""
import clr 
import System
import math 
from System.Collections.Generic import *

clr.AddReference("ProtoGeometry")
from Autodesk.DesignScript.Geometry import *

clr.AddReference('RevitAPI')
import Autodesk
from Autodesk.Revit.DB import *

clr.AddReference('RevitAPIUI')
from Autodesk.Revit.UI import*
from  Autodesk.Revit.UI.Selection import*

clr.AddReference("RevitNodes")
import Revit
clr.ImportExtensions(Revit.Elements)
clr.ImportExtensions(Revit.GeometryConversion)

clr.AddReference("RevitServices")
import RevitServices
from RevitServices.Persistence import DocumentManager
from RevitServices.Transactions import TransactionManager

doc = DocumentManager.Instance.CurrentDBDocument
view = doc.ActiveView
uidoc = DocumentManager.Instance.CurrentUIApplication.ActiveUIDocument

def pickObjects():
    edges = []
    elements = []
    refs = uidoc.Selection.PickObjects(Autodesk.Revit.UI.Selection.ObjectType.Edge, "Please select the Desired Edges")
    #GeoObs = doc.GetElement(refs).GetGeometryObjectFromReference(refs)
    for i in range(len(refs)):
        ele = doc.GetElement(refs[i].ElementId)
        elements.append(ele)
        edge = ele.GetGeometryObjectFromReference(refs[i])
        edges.append(edge.AsCurve().ToProtoType())
        
    return  edges, elements

OUT = pickObjects()
# ----------------------------------------
pickEdges_3 = Python(IN[0]=boolean_11)  # IronPython2; frozen
# ---------- pickEdges_3.python (45 lines) ----------
"""Copyright by: vudinhduybm@gmail.com"""
import clr 
import System
import math 
from System.Collections.Generic import *

clr.AddReference("ProtoGeometry")
from Autodesk.DesignScript.Geometry import *

clr.AddReference('RevitAPI')
import Autodesk
from Autodesk.Revit.DB import *

clr.AddReference('RevitAPIUI')
from Autodesk.Revit.UI import*
from  Autodesk.Revit.UI.Selection import*

clr.AddReference("RevitNodes")
import Revit
clr.ImportExtensions(Revit.Elements)
clr.ImportExtensions(Revit.GeometryConversion)

clr.AddReference("RevitServices")
import RevitServices
from RevitServices.Persistence import DocumentManager
from RevitServices.Transactions import TransactionManager

doc = DocumentManager.Instance.CurrentDBDocument
view = doc.ActiveView
uidoc = DocumentManager.Instance.CurrentUIApplication.ActiveUIDocument

def pickObjects():
    edges = []
    elements = []
    refs = uidoc.Selection.PickObjects(Autodesk.Revit.UI.Selection.ObjectType.Edge, "Please select the Desired Edges")
    #GeoObs = doc.GetElement(refs).GetGeometryObjectFromReference(refs)
    for i in refs:
        ele = doc.GetElement(i.ElementId)
        elements.append(ele)
        edge = ele.GetGeometryObjectFromReference(i)
        edges.append(edge.AsCurve().ToProtoType())
        
    return  edges, elements

OUT = pickObjects()
# ----------------------------------------
code_block_28 = CodeBlock(a=pickEdges_3) { a[0]; }
faces = Element.Faces(element=code_block_20)
wait_for_2 = CodeBlock { [WaitFor,Pass][1]; }  # unwired: WaitFor, Pass
code_block_29 = CodeBlock(a=pickEdges_3) { a[1]; }
retrive_all_edges_of_element = Python(IN[0]=code_block_29)  # IronPython2; frozen
# ---------- retrive_all_edges_of_element.python (68 lines) ----------
"""Copyright by: vudinhduybm@gmail.com"""
import clr 
import System
import math 
from System.Collections.Generic import *

clr.AddReference("ProtoGeometry")
from Autodesk.DesignScript.Geometry import *

clr.AddReference('RevitAPI')
import Autodesk
from Autodesk.Revit.DB import *

clr.AddReference('RevitAPIUI')
from Autodesk.Revit.UI import*
from  Autodesk.Revit.UI.Selection import*

clr.AddReference("RevitNodes")
import Revit
clr.ImportExtensions(Revit.Elements)
clr.ImportExtensions(Revit.GeometryConversion)

clr.AddReference("RevitServices")
import RevitServices
from RevitServices.Persistence import DocumentManager
from RevitServices.Transactions import TransactionManager

clr.AddReference("DSCoreNodes")
from DSCore.List import Flatten

doc = DocumentManager.Instance.CurrentDBDocument
view = doc.ActiveView
uidoc = DocumentManager.Instance.CurrentUIApplication.ActiveUIDocument

#Preparing input from dynamo to revit
def getGeoElement(references): # Get geometry of element.
    geo = []
    opt = Options()
    geoByElement = references.get_Geometry(opt)
    geoEnum = geoByElement.GetEnumerator() 
    geoEnum.MoveNext()
    geoNext = geoEnum.Current.GetInstanceGeometry()
    geo = [i for i in geoNext]
    out = []
    for i in geo:
    	if i.GetType()== Solid and i.Volume > 0:
            edges = i.Edges
            for edge in edges:			
                out.append(edge)	
        if i.GetType() == GeometryInstance:	
            var = i.SymbolGeometry
            for j in var:
                if j.Volume > 0:
                    edges = j.Edges
                    for edge in edges:
                        out.append(edge)
    return out


lstEle = UnwrapElement(IN[0])
if isinstance(lstEle,list):
    elements = UnwrapElement(lstEle)
else:
    elements = [UnwrapElement(lstEle)]
    
lst = [getGeoElement(i) for j in elements for i in j]
        
OUT = lst
# ----------------------------------------
retrive_all_edges_of_element_2 = Python(IN[0]=code_block_29)  # IronPython2; frozen
# ---------- retrive_all_edges_of_element_2.python (68 lines) ----------
"""Copyright by: vudinhduybm@gmail.com"""
import clr 
import System
import math 
from System.Collections.Generic import *

clr.AddReference("ProtoGeometry")
from Autodesk.DesignScript.Geometry import *

clr.AddReference('RevitAPI')
import Autodesk
from Autodesk.Revit.DB import *

clr.AddReference('RevitAPIUI')
from Autodesk.Revit.UI import*
from  Autodesk.Revit.UI.Selection import*

clr.AddReference("RevitNodes")
import Revit
clr.ImportExtensions(Revit.Elements)
clr.ImportExtensions(Revit.GeometryConversion)

clr.AddReference("RevitServices")
import RevitServices
from RevitServices.Persistence import DocumentManager
from RevitServices.Transactions import TransactionManager

clr.AddReference("DSCoreNodes")
from DSCore.List import Flatten

doc = DocumentManager.Instance.CurrentDBDocument
view = doc.ActiveView
uidoc = DocumentManager.Instance.CurrentUIApplication.ActiveUIDocument

#Preparing input from dynamo to revit
def getGeoElement(element): # Get geometry of element.
    geo = []
    opt = Options()
    geoByElement = element.get_Geometry(opt)
    geoEnum = geoByElement.GetEnumerator() 
    geoEnum.MoveNext()
    geoNext = geoEnum.Current.GetInstanceGeometry()
    geo = [i for i in geoNext]
    out = []
    for i in geo:
    	if i.GetType()== Solid and i.Volume > 0:
            edges = i.Edges
            for edge in edges:			
                out.append(edge)	
        if i.GetType() == GeometryInstance:	
            var = i.SymbolGeometry
            for j in var:
                if j.Volume > 0:
                    edges = j.Edges
                    for edge in edges:
                        out.append(edge)
    return out


lstEle = UnwrapElement(IN[0])
if isinstance(lstEle,list):
    elements = UnwrapElement(lstEle)
else:
    elements = [UnwrapElement(lstEle)]
    
lst = [getGeoElement(i) for j in elements for i in j]
        
OUT = lst
# ----------------------------------------
python_script = Python()  # IronPython2; unwired: IN[0]
# ---------- python_script.python (60 lines) ----------
"""Copyright by: vudinhduybm@gmail.com"""
import clr 

import System
from System import Array
from System.Collections.Generic import *

clr.AddReference("ProtoGeometry")
from Autodesk.DesignScript.Geometry import *

clr.AddReference("RevitNodes")
import Revit
clr.ImportExtensions(Revit.Elements)
clr.ImportExtensions(Revit.GeometryConversion)

clr.AddReference("RevitServices")
import RevitServices
from RevitServices.Persistence import DocumentManager
from RevitServices.Transactions import TransactionManager

clr.AddReference('RevitAPI')
clr.AddReference('RevitAPIUI')

import Autodesk
from Autodesk.Revit.DB import MEPCurve
from Autodesk.Revit.UI import*
from Autodesk.Revit.UI.Selection import*

#Current doc/app/ui
doc = DocumentManager.Instance.CurrentDBDocument
uiapp = DocumentManager.Instance.CurrentUIApplication
app = uiapp.Application
uidoc = DocumentManager.Instance.CurrentUIApplication.ActiveUIDocument
view = doc.ActiveView

#Define list/unwrap list functions
def toList(inList):
    result = inList if isinstance(inList, list) else [inList]
    return result

def dList(inList):
    result = inList if isinstance(inList, list) else [inList]
    return UnwrapElement(result)

# preparing input for dynamo to revit
element   = IN[0]

# Do some action in a Transaction
TransactionManager.Instance.EnsureInTransaction(doc)

# Now do something here

TransactionManager.Instance.TransactionTaskDone()

# Output and Changing element to Dynamo for export
# <element>.ToDSType(True), #Not created in script, mark as Revit-owned
# <element>.ToDSType(False) #Created in script, mark as non-Revit-owned

# Output to Dynamo
OUT = dir(MEPCurve)
# ----------------------------------------
python_script_2 = Python()  # IronPython2; unwired: IN[0]
# ---------- python_script_2.python (62 lines) ----------
"""Copyright by: vudinhduybm@gmail.com"""
import clr 

import System
from System import Array
from System.Collections.Generic import *

clr.AddReference("ProtoGeometry")
from Autodesk.DesignScript.Geometry import *

clr.AddReference("RevitNodes")
import Revit
clr.ImportExtensions(Revit.Elements)
clr.ImportExtensions(Revit.GeometryConversion)

clr.AddReference("RevitServices")
import RevitServices
from RevitServices.Persistence import DocumentManager
from RevitServices.Transactions import TransactionManager

clr.AddReference('RevitAPI')
clr.AddReference('RevitAPIUI')

import Autodesk
from Autodesk.Revit.DB import*
from Autodesk.Revit.UI import*
from Autodesk.Revit.UI.Selection import*

#Current doc/app/ui
doc = DocumentManager.Instance.CurrentDBDocument
uiapp = DocumentManager.Instance.CurrentUIApplication
app = uiapp.Application
uidoc = DocumentManager.Instance.CurrentUIApplication.ActiveUIDocument
view = doc.ActiveView

#Define list/unwrap list functions
def toList(inList):
    result = inList if isinstance(inList, list) else [inList]
    return result

def dList(inList):
    result = inList if isinstance(inList, list) else [inList]
    return UnwrapElement(result)

# preparing input for dynamo to revit
element   = IN[0]
elements  = toList(IN[0])
d_List    = dList(IN[0]) 

# Do some action in a Transaction
TransactionManager.Instance.EnsureInTransaction(doc)

# Now do something here

TransactionManager.Instance.TransactionTaskDone()

# Output and Changing element to Dynamo for export
# <element>.ToDSType(True), #Not created in script, mark as Revit-owned
# <element>.ToDSType(False) #Created in script, mark as non-Revit-owned

# Output to Dynamo
OUT = MEPCurve.__doc__, Vector.ByTwoPoints.__doc__,Wall.__doc__
# ----------------------------------------
boolean_12 = BoolSelector(true)  # frozen
rectangleSelectAndFilter = Python(IN[0]=boolean_12)  # IronPython2
# ---------- rectangleSelectAndFilter.python (64 lines) ----------
"""Copyright by: vudinhduybm@gmail.com"""
import clr 

import System
from System import Array
from System.Collections.Generic import *

clr.AddReference("ProtoGeometry")
from Autodesk.DesignScript.Geometry import *

clr.AddReference("RevitNodes")
import Revit
clr.ImportExtensions(Revit.Elements)
clr.ImportExtensions(Revit.GeometryConversion)

clr.AddReference("RevitServices")
import RevitServices
from RevitServices.Persistence import DocumentManager
from RevitServices.Transactions import TransactionManager

clr.AddReference('RevitAPI')
clr.AddReference('RevitAPIUI')

import Autodesk
from Autodesk.Revit.DB import *
from Autodesk.Revit.UI import*
from Autodesk.Revit.UI.Selection import*

#Current doc/app/ui
doc = DocumentManager.Instance.CurrentDBDocument
uiapp = DocumentManager.Instance.CurrentUIApplication
app = uiapp.Application
uidoc = DocumentManager.Instance.CurrentUIApplication.ActiveUIDocument
view = doc.ActiveView

class selectionFilter(ISelectionFilter):
    def __init__(self, category1, category2):
        self.category1 = category1
        self.category2 = category2

    
    def AllowElement(self, element):
        if element.Category.Name == self.category1 or element.Category.Name == self.category2 :
            return True
        else:
            return False
    def AllowReference(reference, point):
        return False
    
ele = selectionFilter('Pipes','Pipe Fittings')
eleAll = uidoc.Selection.PickElementsByRectangle(ele, "Hay chon gia dung")

IDS = List[Autodesk.Revit.DB.ElementId]()
for i in eleAll:
	IDS.Add(i.Id)

TransactionManager.Instance.EnsureInTransaction(doc)
isolateEles = view.IsolateElementsTemporary(IDS)
TransactionManager.Instance.TransactionTaskDone()

OUT = eleAll


	
# ----------------------------------------
boolean_13 = BoolSelector(true)
boolean_14 = BoolSelector(true)  # frozen
retriveAllElementInActiveView = Python(IN[0]=boolean_14)  # IronPython2; unwired: IN[1]
# ---------- retriveAllElementInActiveView.python (39 lines) ----------
"""Copyright by: vudinhduybm@gmail.com"""
import clr 

import System
from System import Array
from System.Collections.Generic import *

clr.AddReference("ProtoGeometry")
from Autodesk.DesignScript.Geometry import *

clr.AddReference("RevitNodes")
import Revit
clr.ImportExtensions(Revit.Elements)
clr.ImportExtensions(Revit.GeometryConversion)

clr.AddReference("RevitServices")
import RevitServices
from RevitServices.Persistence import DocumentManager
from RevitServices.Transactions import TransactionManager

clr.AddReference('RevitAPI')
clr.AddReference('RevitAPIUI')

import Autodesk
from Autodesk.Revit.DB import *
from Autodesk.Revit.UI import*
from Autodesk.Revit.UI.Selection import*
from Autodesk.Revit.DB import FilteredElementCollector, View, Element

#Current doc/app/ui
doc = DocumentManager.Instance.CurrentDBDocument
uiapp = DocumentManager.Instance.CurrentUIApplication
app = uiapp.Application
uidoc = DocumentManager.Instance.CurrentUIApplication.ActiveUIDocument
view = doc.ActiveView

eleInActiveView = FilteredElementCollector(doc, view.Id).ToElements()

OUT = eleInActiveView
# ----------------------------------------
python_script_3 = Python(IN[0]=retriveAllElementInActiveView)  # IronPython2
# ---------- python_script_3.python (64 lines) ----------
"""Copyright by: vudinhduybm@gmail.com"""
import clr 

import System
from System import Array
from System.Collections.Generic import *

clr.AddReference("ProtoGeometry")
from Autodesk.DesignScript.Geometry import *

clr.AddReference("RevitNodes")
import Revit
clr.ImportExtensions(Revit.Elements)
clr.ImportExtensions(Revit.GeometryConversion)

clr.AddReference("RevitServices")
import RevitServices
from RevitServices.Persistence import DocumentManager
from RevitServices.Transactions import TransactionManager

clr.AddReference('RevitAPI')
clr.AddReference('RevitAPIUI')

import Autodesk
from Autodesk.Revit.DB import *
from Autodesk.Revit.UI import*
from Autodesk.Revit.UI.Selection import*

#Current doc/app/ui
doc = DocumentManager.Instance.CurrentDBDocument
uiapp = DocumentManager.Instance.CurrentUIApplication
app = uiapp.Application
uidoc = DocumentManager.Instance.CurrentUIApplication.ActiveUIDocument
view = doc.ActiveView

class selectionFilter(ISelectionFilter):
    def __init__(self, category1, category2,category3, category4):
        self.category1 = category1
        self.category2 = category2
        self.category3 = category3
        self.category4 = category4
    
    def AllowElement(self, element):
        if element.Category.Name == self.category1 or element.Category.Name == self.category2 or element.Category.Name == self.category3 or element.Category.Name == self.category4:
            return True
        else:
            return False
    def AllowReference(reference, point):
        return False
    
filterKeys = selectionFilter('Structural Columns', 'Structural Framing', 'Pipes','Pipe Fittings')
eles = UnwrapElement(IN[0])
IDS = List[Autodesk.Revit.DB.ElementId]()
for i in eles:
	IDS.Add(i.Id)

TransactionManager.Instance.EnsureInTransaction(doc)
isolateEles = view.IsolateElementsTemporary(IDS)
OUT = eles
TransactionManager.Instance.TransactionTaskDone()



	
# ----------------------------------------
rectangleSelectAndFilter_2 = Python(IN[1]=python_script_3)  # IronPython2; unwired: IN[0]
# ---------- rectangleSelectAndFilter_2.python (63 lines) ----------
"""Copyright by: vudinhduybm@gmail.com"""
import clr 

import System
from System import Array
from System.Collections.Generic import *

clr.AddReference("ProtoGeometry")
from Autodesk.DesignScript.Geometry import *

clr.AddReference("RevitNodes")
import Revit
clr.ImportExtensions(Revit.Elements)
clr.ImportExtensions(Revit.GeometryConversion)

clr.AddReference("RevitServices")
import RevitServices
from RevitServices.Persistence import DocumentManager
from RevitServices.Transactions import TransactionManager

clr.AddReference('RevitAPI')
clr.AddReference('RevitAPIUI')

import Autodesk
from Autodesk.Revit.DB import *
from Autodesk.Revit.UI import*
from Autodesk.Revit.UI.Selection import*

#Current doc/app/ui
doc = DocumentManager.Instance.CurrentDBDocument
uiapp = DocumentManager.Instance.CurrentUIApplication
app = uiapp.Application
uidoc = DocumentManager.Instance.CurrentUIApplication.ActiveUIDocument
view = doc.ActiveView

class selectionFilter(ISelectionFilter):
    def __init__(self, category1, category2):
        self.category1 = category1
        self.category2 = category2

    
    def AllowElement(self, element):
        if element.Category.Name == self.category1 or element.Category.Name == self.category2 :
            return True
        else:
            return False
    def AllowReference(reference, point):
        return False
    
eleAll = IN[1]    
IDS = List[Autodesk.Revit.DB.ElementId]()
for i in eleAll:
	IDS.Add(i.Id)
	

TransactionManager.Instance.EnsureInTransaction(doc)
isolateEles = view.IsolateElementsTemporary(IDS)
TransactionManager.Instance.TransactionTaskDone()

OUT = isolateEles


	
# ----------------------------------------
boolean_15 = BoolSelector(false)  # frozen
filteredElementCollection = Python(IN[0]=boolean_15)  # IronPython2; unwired: IN[1]
# ---------- filteredElementCollection.python (48 lines) ----------
"""Copyright by: vudinhduybm@gmail.com"""
import clr 
import sys 
import System   
clr.AddReference("ProtoGeometry")
from Autodesk.DesignScript.Geometry import *

clr.AddReference('RevitAPI') 
from Autodesk.Revit.DB import*
from Autodesk.Revit.DB.Structure import*

clr.AddReference('RevitAPIUI') 
from Autodesk.Revit.UI import*

clr.AddReference('System') 
from System.Collections.Generic import List

clr.AddReference("RevitNodes")
import Revit
clr.ImportExtensions(Revit.Elements)
clr.ImportExtensions(Revit.GeometryConversion)
clr.AddReference('RevitServices') 

import RevitServices
from RevitServices.Persistence import DocumentManager
from RevitServices.Transactions import TransactionManager

#Current doc/app/ui
doc = DocumentManager.Instance.CurrentDBDocument
uiapp = DocumentManager.Instance.CurrentUIApplication
app = uiapp.Application
uidoc = DocumentManager.Instance.CurrentUIApplication.ActiveUIDocument
view = doc.ActiveView

#Define list/unwrap list functions
def toList(inList):
    result = inList if isinstance(inList, list) else [inList]
    return result

def dList(inList):
    result = inList if isinstance(inList, list) else [inList]
    return UnwrapElement(result)

eleLevel = FilteredElementCollector(doc).OfClass(Level).WhereElementIsNotElementType().ToElements()

eleColumns = FilteredElementCollector(doc).OfCategory(BuiltInCategory.OST_StructuralColumns).WhereElementIsNotElementType().ToElements()

OUT = eleColumns
# ----------------------------------------
code_block_30 = CodeBlock { ""; }
code_block_31 = CodeBlock { "OST_"; }
code_block_32 = CodeBlock { ["Walls","Columns","Floor","Framing"]; }
add = code_block_31@L1 + code_block_32
code_block_33 = CodeBlock(a=add) { a; }
code_block_34 = CodeBlock(x=code_block_33) { List.Flatten(x); }
code_block_35 = CodeBlock { ["PipeCurves","PipeFitting"]; }
add_2 = code_block_31@L1 + code_block_35
code_block_36 = CodeBlock(a=add_2) { a; }
code_block_37 = CodeBlock(x=code_block_36) { List.Flatten(x); }
rectangleSelectAndFilter_3 = Python()  # IronPython2; frozen; unwired: IN[0], IN[1]
# ---------- rectangleSelectAndFilter_3.python (54 lines) ----------
"""Copyright by: vudinhduybm@gmail.com"""
import clr 

import System
from System import Array
from System.Collections.Generic import *

clr.AddReference("ProtoGeometry")
from Autodesk.DesignScript.Geometry import *

clr.AddReference("RevitNodes")
import Revit
clr.ImportExtensions(Revit.Elements)
clr.ImportExtensions(Revit.GeometryConversion)

clr.AddReference("RevitServices")
import RevitServices
from RevitServices.Persistence import DocumentManager
from RevitServices.Transactions import TransactionManager

clr.AddReference('RevitAPI')
clr.AddReference('RevitAPIUI')

import Autodesk
from Autodesk.Revit.DB import *
from Autodesk.Revit.UI import*
from Autodesk.Revit.UI.Selection import*

#Current doc/app/ui
doc = DocumentManager.Instance.CurrentDBDocument
uiapp = DocumentManager.Instance.CurrentUIApplication
app = uiapp.Application
uidoc = DocumentManager.Instance.CurrentUIApplication.ActiveUIDocument
view = doc.ActiveView

def getBuilIncategoryOTS(nameCategory): # Get Name of BuiltInCategory
    return [i for i in System.Enum.GetValues(BuiltInCategory) if i == "OST_"+nameCategory or i == nameCategory ]

categoriesIn = IN[1]
categories = []
categoriesFilter = []
for i in categoriesIn:
	categories.append(getBuilIncategoryOTS(i))



TransactionManager.Instance.EnsureInTransaction(doc)

OUT = categories
TransactionManager.Instance.TransactionTaskDone()



	
# ----------------------------------------
code_block_38 = CodeBlock(a=rectangleSelectAndFilter_3) { a; }
code_block_39 = CodeBlock { ["StructuralColumns","StructuralFraming","Floors"]; }
python = Python(IN[1]=code_block_39)  # IronPython2; unwired: IN[0]
# ---------- python.python (48 lines) ----------
"""Copyright by: vudinhduybm@gmail.com"""
import clr 

import System
from System import Array
from System.Collections.Generic import *

clr.AddReference("ProtoGeometry")
from Autodesk.DesignScript.Geometry import *

clr.AddReference("RevitNodes")
import Revit
clr.ImportExtensions(Revit.Elements)
clr.ImportExtensions(Revit.GeometryConversion)

clr.AddReference("RevitServices")
import RevitServices
from RevitServices.Persistence import DocumentManager
from RevitServices.Transactions import TransactionManager

clr.AddReference('RevitAPI')
clr.AddReference('RevitAPIUI')

import Autodesk
from Autodesk.Revit.DB import *
from Autodesk.Revit.UI import*
from Autodesk.Revit.UI.Selection import*

#Current doc/app/ui
doc = DocumentManager.Instance.CurrentDBDocument
uiapp = DocumentManager.Instance.CurrentUIApplication
app = uiapp.Application
uidoc = DocumentManager.Instance.CurrentUIApplication.ActiveUIDocument
view = doc.ActiveView

def getBuilIncategoryByStr(nameCategory): # Get Name of BuiltInCategory
    return [i for i in BuiltInCategory.GetValues(BuiltInCategory) if i == "OST_"+nameCategory or i == nameCategory ]

categoriesIn = UnwrapElement(IN[1])
categories = []
categoriesFilter = []

for i in categoriesIn:
	categories.append(getBuilIncategoryByStr(i))

OUT = categories

	
# ----------------------------------------
python_script_4 = Python()  # IronPython2; unwired: IN[0]
# ---------- python_script_4.python (56 lines) ----------
"""Copyright by: vudinhduybm@gmail.com"""
import clr 
import sys 
import System   
clr.AddReference("ProtoGeometry")
from Autodesk.DesignScript.Geometry import *

clr.AddReference('RevitAPI') 
from Autodesk.Revit.DB import*
from Autodesk.Revit.DB.Structure import*

clr.AddReference('RevitAPIUI') 
from Autodesk.Revit.UI import*

clr.AddReference('System') 
from System.Collections.Generic import List

clr.AddReference('RevitNodes') 
import Revit 
clr.ImportExtensions('Revit.GeometryConversions') 
clr.ImportExtensions('Revit.Elements') 
clr.AddReference('RevitService') 

import RevitServices
from RevitServices.Persistence import DocumentManager
from RevitServices.Transactions import TransactionManager

#Current doc/app/ui
doc = DocumentManager.Instance.CurrentDBDocument
uiapp = DocumentManager.Instance.CurrentUIApplication
app = uiapp.Application
uidoc = DocumentManager.Instance.CurrentUIApplication.ActiveUIDocument
view = doc.ActiveView

#Define list/unwrap list functions
def toList(inList):
    result = inList if isinstance(inList, list) else [inList]
    return result

def dList(inList):
    result = inList if isinstance(inList, list) else [inList]
    return UnwrapElement(result)

# preparing input for dynamo to revit
element   = IN[0]
elements  = toList(IN[0])
d_List    = dList(IN[0]) 

# Do some action in a Transaction
TransactionManager.Instance.EnsureInTransaction(doc)

# Now do something here

TransactionManager.Instance.TransactionTaskDone()

OUT = element
# ----------------------------------------
boolean_16 = BoolSelector(false)
python_2 = Python(IN[0]=boolean_16, IN[1]=code_block_39)  # IronPython2; frozen
# ---------- python_2.python (58 lines) ----------
"""Copyright by: vudinhduybm@gmail.com"""
import clr 

import System
from System import Array
from System.Collections.Generic import *

clr.AddReference("ProtoGeometry")
from Autodesk.DesignScript.Geometry import *

clr.AddReference("RevitNodes")
import Revit
clr.ImportExtensions(Revit.Elements)
clr.ImportExtensions(Revit.GeometryConversion)

clr.AddReference("RevitServices")
import RevitServices
from RevitServices.Persistence import DocumentManager
from RevitServices.Transactions import TransactionManager

clr.AddReference('RevitAPI')
clr.AddReference('RevitAPIUI')

import Autodesk
from Autodesk.Revit.DB import *
from Autodesk.Revit.UI import*
from Autodesk.Revit.UI.Selection import*

#Current doc/app/ui
doc = DocumentManager.Instance.CurrentDBDocument
uiapp = DocumentManager.Instance.CurrentUIApplication
app = uiapp.Application
uidoc = DocumentManager.Instance.CurrentUIApplication.ActiveUIDocument
view = doc.ActiveView

def getBuilIncategoryOTS(nameCategory): # Get Name of BuiltInCategory
    return [i for i in System.Enum.GetValues(BuiltInCategory) if i == "OST_"+nameCategory or i == nameCategory ]

categoriesIn = UnwrapElement(IN[1])
categories = []
categoriesFilter = []

categories.append(getBuilIncategoryOTS(i) for i in categories)
categoriesFilter.append([FilteredElementCollector(doc).OfCategory(c) for c in categories])
combineFilter = LogicalOrFilter(categoriesFilter)
desEle = combineFilter.ToElements()

IDS = List[Autodesk.Revit.DB.ElementId]()
for i in desEle:
	IDS.Add(i.Id)

TransactionManager.Instance.EnsureInTransaction(doc)
isolateEles = view.IsolateElementsTemporary(IDS)
TransactionManager.Instance.TransactionTaskDone()

OUT = desEle

	
# ----------------------------------------
python_script_5 = Python(IN[1]=code_block_39)  # IronPython2; unwired: IN[0]
# ---------- python_script_5.python (65 lines) ----------
"""Copyright by: vudinhduybm@gmail.com"""
import clr 
import sys 
import System   
clr.AddReference("ProtoGeometry")
from Autodesk.DesignScript.Geometry import *

clr.AddReference("RevitAPI") 
from Autodesk.Revit.DB import*
from Autodesk.Revit.DB.Structure import*

clr.AddReference("RevitAPIUI") 
from Autodesk.Revit.UI import*

clr.AddReference("System") 
from System.Collections.Generic import List

clr.AddReference("RevitNodes")
import Revit
clr.ImportExtensions(Revit.Elements)
clr.ImportExtensions(Revit.GeometryConversion)

clr.AddReference("RevitServices")
import RevitServices
from RevitServices.Persistence import DocumentManager
from RevitServices.Transactions import TransactionManager

#Current doc/app/ui
doc = DocumentManager.Instance.CurrentDBDocument
uiapp = DocumentManager.Instance.CurrentUIApplication
app = uiapp.Application
uidoc = DocumentManager.Instance.CurrentUIApplication.ActiveUIDocument
view = doc.ActiveView

#Define list/unwrap list functions
def toList(inList):
    result = inList if isinstance(inList, list) else [inList]
    return result

def dList(inList):
    result = inList if isinstance(inList, list) else [inList]
    return UnwrapElement(result)

def getBuiltInCategories(categoriesIn):
	builtInCategories= []
	for category in categoriesIn:
		builtInCategories = BuiltInCategory.INVALID
		try:
			builtInCategory = BuiltInCategory[str(category)]
		except:
			pass
		if builtInCategory != BuiltInCategory.INVALID:
			builtInCategories.append(builtInCategory)
	return builtInCategories


# preparing input for dynamo to revit
element   = IN[1]
categoriesIn  = toList(IN[1])

# preparing input for dynamo to revit
buitlInCategories = getBuiltInCategories(categoriesIn)


OUT = buitlInCategories
# ----------------------------------------
python_3 = Python(IN[0]=code_block_39)  # IronPython2; frozen
# ---------- python_3.python (62 lines) ----------
"""Copyright by: vudinhduybm@gmail.com"""
import clr 
import sys 
import System   
clr.AddReference("ProtoGeometry")
from Autodesk.DesignScript.Geometry import *

clr.AddReference("RevitAPI") 
from Autodesk.Revit.DB import*
from Autodesk.Revit.DB.Structure import*

clr.AddReference("RevitAPIUI") 
from Autodesk.Revit.UI import*

clr.AddReference("System") 
from System.Collections.Generic import List

clr.AddReference("RevitNodes")
import Revit
clr.ImportExtensions(Revit.Elements)
clr.ImportExtensions(Revit.GeometryConversion)

clr.AddReference("RevitServices")
import RevitServices
from RevitServices.Persistence import DocumentManager
from RevitServices.Transactions import TransactionManager

#Current doc/app/ui
doc = DocumentManager.Instance.CurrentDBDocument
uiapp = DocumentManager.Instance.CurrentUIApplication
app = uiapp.Application
uidoc = DocumentManager.Instance.CurrentUIApplication.ActiveUIDocument
view = doc.ActiveView


def getBuiltInCategoryOTS(nameCategory): # Get Name of BuiltInCategory
    return [i for i in System.Enum.GetValues(BuiltInCategory) if i.ToString() == "OST_"+nameCategory or i.ToString() == nameCategory ]

categoriesIn = IN[0]
categories = []
categoriesFilter = []

for i in categoriesIn:
	cat = getBuiltInCategoryOTS(i)
	categories.append(cat)
flat_categories = [item for sublist in categories for item in sublist]

for c in flat_categories:
	collector = FilteredElementCollector(doc).OfCategory(c).WhereElementIsNotElementType()
	categoriesFilter.append(collector)
	
desEle = categoriesFilter.ToElements()

IDS = List[Autodesk.Revit.DB.ElementId]()
for i in desEle:
	IDS.Add(i.Id)

TransactionManager.Instance.EnsureInTransaction(doc)
isolateEles = view.IsolateElementsTemporary(IDS)
TransactionManager.Instance.TransactionTaskDone()

OUT = desEle
# ----------------------------------------
code_block_40 = CodeBlock { ["PipeCurves"]; }
boolean_17 = BoolSelector(true)
getAllPipingSystemInActiveView = Python(IN[0]=boolean_17)  # IronPython2; unwired: IN[1]
# ---------- getAllPipingSystemInActiveView.python (47 lines) ----------
"""Copyright by: vudinhduybm@gmail.com"""
import clr 
import sys 
import System   
clr.AddReference("ProtoGeometry")
from Autodesk.DesignScript.Geometry import *

clr.AddReference("RevitAPI") 
from Autodesk.Revit.DB import*
from Autodesk.Revit.DB.Structure import*

clr.AddReference("RevitAPIUI") 
from Autodesk.Revit.UI import*

clr.AddReference("System") 
from System.Collections.Generic import List

clr.AddReference("RevitNodes")
import Revit
clr.ImportExtensions(Revit.Elements)
clr.ImportExtensions(Revit.GeometryConversion)

clr.AddReference("RevitServices")
import RevitServices
from RevitServices.Persistence import DocumentManager
from RevitServices.Transactions import TransactionManager

#Current doc/app/ui
doc = DocumentManager.Instance.CurrentDBDocument
uiapp = DocumentManager.Instance.CurrentUIApplication
app = uiapp.Application
uidoc = DocumentManager.Instance.CurrentUIApplication.ActiveUIDocument
view = doc.ActiveView

def getAllPipingSystemsInActiveView(doc):
	collector = FilteredElementCollector(doc, doc.ActiveView.Id).OfCategory(BuiltInCategory.OST_PipingSystem)
	pipingSystems = collector.ToElements()
	pipingSystemsName = []
	
	for system in pipingSystems:
		systemName = system.get_Parameter(BuiltInParameter.RBS_SYSTEM_NAME_PARAM).AsString()
		pipingSystemsName.append(systemName)
	return pipingSystemsName
	
	
	
OUT = getAllPipingSystemsInActiveView(doc)
# ----------------------------------------
code_block_41 = CodeBlock { true; }
boolean_18 = BoolSelector(false)
getAllPipingSystemInActiveView_2 = Python(IN[0]=boolean_18)  # IronPython2; unwired: IN[1]
# ---------- getAllPipingSystemInActiveView_2.python (62 lines) ----------
"""Copyright by: vudinhduybm@gmail.com"""
import clr 
import sys 
import System   
clr.AddReference("ProtoGeometry")
from Autodesk.DesignScript.Geometry import *

clr.AddReference("RevitAPI") 
from Autodesk.Revit.DB import*
from Autodesk.Revit.DB.Structure import*

clr.AddReference("RevitAPIUI") 
from Autodesk.Revit.UI import*

clr.AddReference("System") 
from System.Collections.Generic import List

clr.AddReference("RevitNodes")
import Revit
clr.ImportExtensions(Revit.Elements)
clr.ImportExtensions(Revit.GeometryConversion)

clr.AddReference("RevitServices")
import RevitServices
from RevitServices.Persistence import DocumentManager
from RevitServices.Transactions import TransactionManager

#Current doc/app/ui
doc = DocumentManager.Instance.CurrentDBDocument
uiapp = DocumentManager.Instance.CurrentUIApplication
app = uiapp.Application
uidoc = DocumentManager.Instance.CurrentUIApplication.ActiveUIDocument
view = doc.ActiveView

def getAllPipingSystemsInActiveView(doc):
	collector = FilteredElementCollector(doc, doc.ActiveView.Id).OfCategory(BuiltInCategory.OST_PipingSystem)
	pipingSystems = collector.ToElements()
	pipingSystemsName = []
	
	for system in pipingSystems:
		systemName = system.get_Parameter(BuiltInParameter.RBS_SYSTEM_NAME_PARAM).AsString()
		pipingSystemsName.append(systemName)
	return pipingSystemsName
	
def getBuiltInCategoryOST(nameCategory): # Get Name of BuiltInCategory
    return [i for i in System.Enum.GetValues(BuiltInCategory) if i.ToString() == "OST_"+ str(nameCategory) or i.ToString() == (nameCategory) ]

categoriesIN = ["OST_PipeCurves", "OST_PipeFitting"]
categories = [getBuiltInCategoryOST(category) for category in categoriesIN]
flat_categories = [item for sublist in categories for item in sublist]

categoriesFilter = []
for c in flat_categories:
    collector = FilteredElementCollector(doc).OfCategory(c).WhereElementIsNotElementType()
    categoriesFilter.append(collector)
flat_categoriesFilter = [[item for item in sublist] for sublist in categoriesFilter]





OUT = flat_categoriesFilter
# ----------------------------------------
file_path = Filename(".\processing.py")  # frozen
number = DoubleInput(700)
code_block_42 = CodeBlock { "汚水"; }
string_from_object = FromObject(object=code_block_42)

# group: VS Code
boolean_19 = BoolSelector(true)
python_script_6 = Python(IN[0]=boolean_19, IN[1]=file_path)  # IronPython2
# ---------- python_script_6.python (5 lines) ----------
re  = open(r"C:\Users\Desktop\Python\02_PyRevit\04_Processing\processing.py", "r")

interpret = re.read()

OUT =  interpret
# ----------------------------------------
python_script_from_string = PythonStringNode(script=python_script_6, IN[1]=number, IN[2]=string_from_object)  # IronPython2; unwired: IN[0]

code_block_43 = CodeBlock(a=python_script_from_string) { a; }
filterAndIsolateElementByBuiltinCategory = Custom[filterAndIsolateElementByBuiltinCategory]()  # package Duynamo; from Duynamo filter and isolate element by builtin category; unwired: catrgories
boolean_20 = BoolSelector(true)
number_2 = DoubleInput(300)
code_block_44 = CodeBlock { "汚水"; }
python_script_7 = Python(IN[0]=boolean_20, IN[1]=number_2, IN[2]=code_block_44)  # IronPython2; frozen
# ---------- python_script_7.python (78 lines) ----------
"""Copyright by: vudinhduybm@gmail.com"""
import clr 
import sys 
import System   
clr.AddReference("ProtoGeometry")
from Autodesk.DesignScript.Geometry import *

clr.AddReference("RevitAPI") 
from Autodesk.Revit.DB import*
from Autodesk.Revit.DB.Structure import*

clr.AddReference("RevitAPIUI") 
from Autodesk.Revit.UI import*

clr.AddReference("System") 
from System.Collections.Generic import List

clr.AddReference("RevitNodes")
import Revit
clr.ImportExtensions(Revit.Elements)
clr.ImportExtensions(Revit.GeometryConversion)

clr.AddReference("RevitServices")
import RevitServices
from RevitServices.Persistence import DocumentManager
from RevitServices.Transactions import TransactionManager

#Current doc/app/ui
doc = DocumentManager.Instance.CurrentDBDocument
uiapp = DocumentManager.Instance.CurrentUIApplication
app = uiapp.Application
uidoc = DocumentManager.Instance.CurrentUIApplication.ActiveUIDocument
view = doc.ActiveView

diameterIN = IN[1]
inSystemName = IN[2]

def getAllPipingSystemsInActiveView(doc):
	collector = FilteredElementCollector(doc, doc.ActiveView.Id).OfCategory(BuiltInCategory.OST_PipingSystem)
	pipingSystems = collector.ToElements()
	pipingSystemsName = []
	
	for system in pipingSystems:
		systemName = system.get_Parameter(BuiltInParameter.SYMBOL_NAME_PARAM).AsString()
		pipingSystemsName.append(systemName)
	return pipingSystemsName, pipingSystems

allPipingSystemsInActiveView = getAllPipingSystemsInActiveView(doc)
allPipingSystemName = allPipingSystemsInActiveView[0]
allPipingSystem = allPipingSystemsInActiveView[1]
idOfInSystem = allPipingSystemName.index(inSystemName)
desPipingSystem = allPipingSystem[idOfInSystem]

categories = [BuiltInCategory.OST_PipeCurves]
categoriesFilter = []
for c in categories:
    collector = FilteredElementCollector(doc).OfCategory(c).WhereElementIsNotElementType().ToElements()
    categoriesFilter.append(collector)
flat_categoriesFilter = [[item for item in sublist] for sublist in categoriesFilter]
IDS = List[ElementId]()
for i in flat_categoriesFilter:
	IDS.Add(i.Id)

paramFilter1 = ParameterValueProvider(ElementId(BuiltInParameter.RBS_PIPE_DIAMETER_PARAM))
reason1 = FilterNumericGreater()
i_Check = IN[1]/304.8
fRule1 = FilterDoubleRule(paramFilter1,reason1,i_Check,0.02)
filter1 = ElementParameterFilter(fRule1)
elems1 = FilteredElementCollector(doc).WherePasses(fRule1).WhereElementIsNotElementType().ToElements()

combineFilter = LogicalAndFilter(desPipingSystem , fRule1)
collectorDesPipes = FilteredElementCollector(doc, IDS).WherePasses(combineFilter).ToElements()




# OUT = [desPipingSystem],[ inSystemName]
OUT = collectorDesPipes
# ----------------------------------------
boolean_21 = BoolSelector(false)  # frozen
pickObjects_2 = Custom[pickObjects](Reset=boolean_21)
string = StringInput("")
python_script_8 = Python()  # IronPython2; frozen; unwired: IN[0]
# ---------- python_script_8.python (45 lines) ----------
"""Copyright by: vudinhduybm@gmail.com"""
import clr 
import sys 
import System   
clr.AddReference("ProtoGeometry")
from Autodesk.DesignScript.Geometry import *

clr.AddReference("RevitAPI") 
from Autodesk.Revit.DB import*
from Autodesk.Revit.DB.Structure import*

clr.AddReference("RevitAPIUI") 
from Autodesk.Revit.UI import*

clr.AddReference("System") 
from System.Collections.Generic import List

clr.AddReference("RevitNodes")
import Revit
clr.ImportExtensions(Revit.Elements)
clr.ImportExtensions(Revit.GeometryConversion)

clr.AddReference("RevitServices")
import RevitServices
from RevitServices.Persistence import DocumentManager
from RevitServices.Transactions import TransactionManager

#Current doc/app/ui
doc = DocumentManager.Instance.CurrentDBDocument
uiapp = DocumentManager.Instance.CurrentUIApplication
app = uiapp.Application
uidoc = DocumentManager.Instance.CurrentUIApplication.ActiveUIDocument
view = doc.ActiveView

def getAllPipingSystemsInActiveView(doc):
	collector = FilteredElementCollector(doc, view.Id).OfCategory(BuiltInCategory.OST_PipingSystem)
	pipingSystems = collector.ToElements()
	pipingSystemsName = []
	
	for system in pipingSystems:
		systemName = system.get_Parameter(BuiltInParameter.RBS_SYSTEM_NAME_PARAM).AsString()
		pipingSystemsName.append(systemName)
	return pipingSystemsName, pipingSystems
	
OUT = getAllPipingSystemsInActiveView(doc)
# ----------------------------------------
python_script_9 = Python()  # IronPython2; unwired: IN[0]
# ---------- python_script_9.python (56 lines) ----------
"""Copyright by: vudinhduybm@gmail.com"""
import clr 
import sys 
import System   
clr.AddReference("ProtoGeometry")
from Autodesk.DesignScript.Geometry import *

clr.AddReference("RevitAPI") 
from Autodesk.Revit.DB import*
from Autodesk.Revit.DB.Structure import*

clr.AddReference("RevitAPIUI") 
from Autodesk.Revit.UI import*

clr.AddReference("System") 
from System.Collections.Generic import List

clr.AddReference("RevitNodes")
import Revit
clr.ImportExtensions(Revit.Elements)
clr.ImportExtensions(Revit.GeometryConversion)

clr.AddReference("RevitServices")
import RevitServices
from RevitServices.Persistence import DocumentManager
from RevitServices.Transactions import TransactionManager

#Current doc/app/ui
doc = DocumentManager.Instance.CurrentDBDocument
uiapp = DocumentManager.Instance.CurrentUIApplication
app = uiapp.Application
uidoc = DocumentManager.Instance.CurrentUIApplication.ActiveUIDocument
view = doc.ActiveView

#Define list/unwrap list functions
def toList(inList):
    result = inList if isinstance(inList, list) else [inList]
    return result

def dList(inList):
    result = inList if isinstance(inList, list) else [inList]
    return UnwrapElement(result)

# preparing input for dynamo to revit
element   = IN[0]
elements  = toList(IN[0])
d_List    = dList(IN[0]) 

# Do some action in a Transaction
TransactionManager.Instance.EnsureInTransaction(doc)

# Now do something here

TransactionManager.Instance.TransactionTaskDone()

OUT = element
# ----------------------------------------
boolean_22 = BoolSelector(false)
number_3 = DoubleInput(700)
string_2 = StringInput("汚水")
filterPipesByDNandSystemType = Python(IN[0]=boolean_22, IN[1]=number_3, IN[2]=string_2)  # IronPython2; frozen
# ---------- filterPipesByDNandSystemType.python (66 lines) ----------
"""Copyright by: vudinhduybm@gmail.com"""
import clr 
import sys 
import System   
clr.AddReference("ProtoGeometry")
from Autodesk.DesignScript.Geometry import *

clr.AddReference("RevitAPI") 
from Autodesk.Revit.DB import*
from Autodesk.Revit.DB.Structure import*

clr.AddReference("RevitAPIUI") 
from Autodesk.Revit.UI import*

clr.AddReference("System") 
from System.Collections.Generic import List

clr.AddReference("RevitNodes")
import Revit
clr.ImportExtensions(Revit.Elements)
clr.ImportExtensions(Revit.GeometryConversion)

clr.AddReference("RevitServices")
import RevitServices
from RevitServices.Persistence import DocumentManager
from RevitServices.Transactions import TransactionManager

#Current doc/app/ui
doc = DocumentManager.Instance.CurrentDBDocument
uiapp = DocumentManager.Instance.CurrentUIApplication
app = uiapp.Application
uidoc = DocumentManager.Instance.CurrentUIApplication.ActiveUIDocument
view = doc.ActiveView

diameterIN = UnwrapElement(IN[1])
inSystemName = UnwrapElement(IN[2])

categories = [BuiltInCategory.OST_PipeCurves]
categoriesFilter = []
for c in categories:
    collector = FilteredElementCollector(doc).OfCategory(c).WhereElementIsNotElementType()
    categoriesFilter.append(collector)
flat_categoriesFilter = [item for sublist in categoriesFilter for item in sublist]

IDS = List[ElementId]()
for i in flat_categoriesFilter:
	IDS.Add(i.Id)


desPipes = []

paramFilter1 = ParameterValueProvider(ElementId(BuiltInParameter.RBS_PIPING_SYSTEM_TYPE_PARAM))
reason1 = FilterStringEquals()
fRule = FilterStringRule(paramFilter1,reason1, inSystemName)
filter1 = ElementParameterFilter(fRule)

i_Check = IN[1]/304.8
paramFilter2 = ParameterValueProvider(ElementId(BuiltInParameter.RBS_PIPE_DIAMETER_PARAM))
reason2 = FilterNumericEquals()
reason3 = FilterNumericGreaterOrEqual()
fRule2 = FilterDoubleRule(paramFilter2,reason2,i_Check,0.02)
filter2 = ElementParameterFilter(fRule2)
combineFilter = LogicalAndFilter(filter1 , filter2)
desPipes = FilteredElementCollector(doc, IDS).WherePasses(filter2).WhereElementIsNotElementType().ToElements()

OUT = desPipes
# ----------------------------------------
code_block_45 = CodeBlock { "汚水"; }
python_script_10 = Python()  # IronPython2; unwired: IN[0]
# ---------- python_script_10.python (43 lines) ----------
"""Copyright by: vudinhduybm@gmail.com"""
import clr 
import sys 
import System   
clr.AddReference("ProtoGeometry")
from Autodesk.DesignScript.Geometry import *

clr.AddReference("RevitAPI") 
from Autodesk.Revit.DB import*
from Autodesk.Revit.DB.Structure import*

clr.AddReference("RevitAPIUI") 
from Autodesk.Revit.UI import*

clr.AddReference("System") 
from System.Collections.Generic import List

clr.AddReference("RevitNodes")
import Revit
clr.ImportExtensions(Revit.Elements)
clr.ImportExtensions(Revit.GeometryConversion)

clr.AddReference("RevitServices")
import RevitServices
from RevitServices.Persistence import DocumentManager
from RevitServices.Transactions import TransactionManager

#Current doc/app/ui
doc = DocumentManager.Instance.CurrentDBDocument
uiapp = DocumentManager.Instance.CurrentUIApplication
app = uiapp.Application
uidoc = DocumentManager.Instance.CurrentUIApplication.ActiveUIDocument
view = doc.ActiveView

cateList = List[BuiltInCategory]()

cateList.Add(BuiltInCategory.OST_StructuralColumns)
cateList.Add(BuiltInCategory.OST_StructuralFraming)

_filter = ElementMulticategoryFilter(cateList)
elems = FilteredElementCollector(doc).WherePasses(_filter).WhereElementIsNotElementType().ToElements()

OUT = elems
# ----------------------------------------
