# Dynamo graph PipeCreate.dyn (Dynamo 2.10.1.3976)
# packages: Duynamo 2022.12.24

boolean = BoolSelector(false)  # frozen
file_path = Filename("..\PipeCreate.py")
python_script = Python(IN[0]=boolean, IN[1]=file_path)  # IronPython2
# ---------- python_script.python (5 lines) ----------
re  = open(r"C:\Users\95053\Desktop\Python\RevitAPI-master\RevitAPI\PipeCreate.py", "r")

interpret = re.read()

OUT =  interpret
# ----------------------------------------
python_script_from_string = PythonStringNode(script=python_script)  # IronPython2; unwired: IN[0]
boolean_2 = BoolSelector(false)  # frozen
file_path_2 = Filename("..\clickButton.py")
python_script_2 = Python(IN[0]=boolean_2, IN[1]=file_path_2)  # IronPython2
# ---------- python_script_2.python (5 lines) ----------
re  = open(r"C:\Users\95053\Desktop\Python\RevitAPI-master\RevitAPI\\clickButton.py", "r")

interpret = re.read()

OUT =  interpret
# ----------------------------------------
python_script_from_string_2 = PythonStringNode(script=python_script_2)  # IronPython2; unwired: IN[0]
python_script_3 = Python()  # IronPython2; frozen; unwired: IN[0]
# ---------- python_script_3.python (345 lines) ----------
import clr
import sys 
import System   
clr.AddReference("ProtoGeometry")
from Autodesk.DesignScript.Geometry import *

clr.AddReference("RevitAPI") 
from Autodesk.Revit.DB import*
from Autodesk.Revit.DB.Structure import*

clr.AddReference("RevitAPIUI") 
from Autodesk.Revit.UI import*

clr.AddReference("System") 
from System.Collections.Generic import List

clr.AddReference("RevitNodes")
import Revit
clr.ImportExtensions(Revit.Elements)
clr.ImportExtensions(Revit.GeometryConversion)

clr.AddReference("RevitServices")
import RevitServices
from RevitServices.Persistence import DocumentManager
from RevitServices.Transactions import TransactionManager

clr.AddReference("System.Windows.Forms")
clr.AddReference("System.Drawing")
clr.AddReference("System.Windows.Forms.DataVisualization")

import System.Windows.Forms 
from System.Windows.Forms import *
import System.Drawing
from System.Drawing import *


doc = DocumentManager.Instance.CurrentDBDocument
uiapp = DocumentManager.Instance.CurrentUIApplication
app = uiapp.Application
uidoc = DocumentManager.Instance.CurrentUIApplication.ActiveUIDocument
view = doc.ActiveView



def getAllPipingSystems(doc):
	collector = FilteredElementCollector(doc, view.Id).OfCategory(BuiltInCategory.OST_PipingSystem)
	pipingSystems = collector.ToElements()
	pipingSystemsName = []
	for system in pipingSystems:
		systemName = system.get_Parameter(BuiltInParameter.SYMBOL_NAME_PARAM).AsString()
		pipingSystemsName.append(systemName)
	return pipingSystemsName

pipingSystemsCollector = getAllPipingSystems(doc)

def getAllPipeTypes(doc):
	collector1 = FilteredElementCollector(doc, view.Id).OfCategory(BuiltInCategory.OST_PipeCurves)
	pipeTypes = collector1.ToElements()
	pipeTypesName = []
	for pipeType in pipeTypes:
		pipeTypeName = pipeType.get_Parameter(BuiltInParameter.SYMBOL_NAME_PARAM).AsString()
		pipeTypesName.append(pipeTypeName)
	return pipeTypesName

pipeTypesCollector = getAllPipeTypes(doc)

levelsCollector = FilteredElementCollector(doc).OfClass(Level).ToElements()
levelsNameCollector = []
for level in levelsCollector:
	levelName = level.Name
	levelsNameCollector.append(levelName)

class MainForm(Form):
	def __init__(self):
		self.InitializeComponent()
	
	def InitializeComponent(self):
		self._groupBox1 = System.Windows.Forms.GroupBox()
		self._button1 = System.Windows.Forms.Button()
		self._button2 = System.Windows.Forms.Button()
		self._comboBox1 = System.Windows.Forms.ComboBox()
		self._label1 = System.Windows.Forms.Label()
		self._groupBox2 = System.Windows.Forms.GroupBox()
		self._label2 = System.Windows.Forms.Label()
		self._comboBox2 = System.Windows.Forms.ComboBox()
		self._groupBox3 = System.Windows.Forms.GroupBox()
		self._label3 = System.Windows.Forms.Label()
		self._comboBox3 = System.Windows.Forms.ComboBox()
		self._groupBox4 = System.Windows.Forms.GroupBox()
		self._label4 = System.Windows.Forms.Label()
		self._textBox1 = System.Windows.Forms.TextBox()
		self._button3 = System.Windows.Forms.Button()
		self._button4 = System.Windows.Forms.Button()
		self._label5 = System.Windows.Forms.Label()
		self._groupBox1.SuspendLayout()
		self._groupBox2.SuspendLayout()
		self._groupBox3.SuspendLayout()
		self._groupBox4.SuspendLayout()
		self.SuspendLayout()
		# 
		# groupBox1
		# 
		self._groupBox1.Controls.Add(self._label1)
		self._groupBox1.Controls.Add(self._comboBox1)
		self._groupBox1.Location = System.Drawing.Point(12, 159)
		self._groupBox1.Name = "groupBox1"
		self._groupBox1.Size = System.Drawing.Size(449, 47)
		self._groupBox1.TabIndex = 0
		self._groupBox1.TabStop = False
		# 
		# button1
		# 
		self._button1.BackColor = System.Drawing.SystemColors.Info
		self._button1.Font = System.Drawing.Font("MS UI Gothic", 10, System.Drawing.FontStyle.Bold | System.Drawing.FontStyle.Underline, System.Drawing.GraphicsUnit.Point, 128, True)
		self._button1.ForeColor = System.Drawing.Color.Red
		self._button1.Location = System.Drawing.Point(52, 28)
		self._button1.Name = "button1"
		self._button1.Size = System.Drawing.Size(140, 58)
		self._button1.TabIndex = 1
		self._button1.Text = "get X,Y value"
		self._button1.UseVisualStyleBackColor = False
		# 
		# button2
		# 
		self._button2.BackColor = System.Drawing.SystemColors.Info
		self._button2.Cursor = System.Windows.Forms.Cursors.AppStarting
		self._button2.Font = System.Drawing.Font("MS UI Gothic", 10, System.Drawing.FontStyle.Bold | System.Drawing.FontStyle.Underline, System.Drawing.GraphicsUnit.Point, 128, True)
		self._button2.ForeColor = System.Drawing.Color.Red
		self._button2.Location = System.Drawing.Point(279, 28)
		self._button2.Name = "button2"
		self._button2.Size = System.Drawing.Size(140, 58)
		self._button2.TabIndex = 2
		self._button2.Text = "get Z value"
		self._button2.UseVisualStyleBackColor = False
		# 
		# comboBox1
		# 
		self._comboBox1.AllowDrop = True
		self._comboBox1.Cursor = System.Windows.Forms.Cursors.AppStarting
		self._comboBox1.FormattingEnabled = True
		self._comboBox1.Location = System.Drawing.Point(180, 12)
		self._comboBox1.Name = "comboBox1"
		self._comboBox1.Size = System.Drawing.Size(263, 23)
		self._comboBox1.TabIndex = 3
		self._comboBox1.SelectedIndexChanged += self.ComboBox1_SelectedIndexChanged
		self._comboBox1.Items.AddRange(System.Array[System.Object](pipingSystemsCollector))

		# 
		# label1
		# 
		self._label1.BackColor = System.Drawing.SystemColors.Info
		self._label1.BorderStyle = System.Windows.Forms.BorderStyle.Fixed3D
		self._label1.Font = System.Drawing.Font("MS UI Gothic", 9, System.Drawing.FontStyle.Bold, System.Drawing.GraphicsUnit.Point, 128)
		self._label1.ForeColor = System.Drawing.Color.Blue
		self._label1.Location = System.Drawing.Point(19, 12)
		self._label1.Name = "label1"
		self._label1.Size = System.Drawing.Size(142, 23)
		self._label1.TabIndex = 4
		self._label1.Text = "PipingSystemType"
		# 
		# groupBox2
		# 
		self._groupBox2.Controls.Add(self._label2)
		self._groupBox2.Controls.Add(self._comboBox2)
		self._groupBox2.Location = System.Drawing.Point(12, 212)
		self._groupBox2.Name = "groupBox2"
		self._groupBox2.Size = System.Drawing.Size(449, 47)
		self._groupBox2.TabIndex = 5
		self._groupBox2.TabStop = False
		# 
		# label2
		# 
		self._label2.BackColor = System.Drawing.SystemColors.Info
		self._label2.BorderStyle = System.Windows.Forms.BorderStyle.Fixed3D
		self._label2.Font = System.Drawing.Font("MS UI Gothic", 9, System.Drawing.FontStyle.Bold, System.Drawing.GraphicsUnit.Point, 128)
		self._label2.ForeColor = System.Drawing.Color.Blue
		self._label2.Location = System.Drawing.Point(19, 12)
		self._label2.Name = "label2"
		self._label2.Size = System.Drawing.Size(142, 23)
		self._label2.TabIndex = 4
		self._label2.Text = "PipeType"
		self._label2.Click += self.Label2Click
		# 
		# comboBox2
		# 
		self._comboBox2.AllowDrop = True
		self._comboBox2.Cursor = System.Windows.Forms.Cursors.AppStarting
		self._comboBox2.FormattingEnabled = True
		self._comboBox2.Location = System.Drawing.Point(180, 12)
		self._comboBox2.Name = "comboBox2"
		self._comboBox2.Size = System.Drawing.Size(263, 23)
		self._comboBox2.TabIndex = 3
		self._comboBox2.SelectedIndexChanged += self.ComboBox2_SelectedIndexChanged
		self._comboBox2.Items.AddRange(System.Array[System.Object](pipeTypesCollector))		
		# 
		# groupBox3
		# 
		self._groupBox3.Controls.Add(self._label3)
		self._groupBox3.Controls.Add(self._comboBox3)
		self._groupBox3.Location = System.Drawing.Point(12, 265)
		self._groupBox3.Name = "groupBox3"
		self._groupBox3.Size = System.Drawing.Size(449, 47)
		self._groupBox3.TabIndex = 6
		self._groupBox3.TabStop = False
		# 
		# label3
		# 
		self._label3.BackColor = System.Drawing.SystemColors.Info
		self._label3.BorderStyle = System.Windows.Forms.BorderStyle.Fixed3D
		self._label3.Font = System.Drawing.Font("MS UI Gothic", 9, System.Drawing.FontStyle.Bold, System.Drawing.GraphicsUnit.Point, 128)
		self._label3.ForeColor = System.Drawing.Color.Blue
		self._label3.Location = System.Drawing.Point(19, 12)
		self._label3.Name = "label3"
		self._label3.Size = System.Drawing.Size(142, 23)
		self._label3.TabIndex = 4
		self._label3.Text = "RefLevel"
		# 
		# comboBox3
		# 
		self._comboBox3.AllowDrop = True
		self._comboBox3.Cursor = System.Windows.Forms.Cursors.AppStarting
		self._comboBox3.FormattingEnabled = True
		self._comboBox3.Location = System.Drawing.Point(180, 12)
		self._comboBox3.Name = "comboBox3"
		self._comboBox3.Size = System.Drawing.Size(263, 23)
		self._comboBox3.TabIndex = 3
		self._comboBox3.SelectedIndexChanged += self.ComboBox3_SelectedIndexChanged
		self._comboBox3.Items.AddRange(System.Array[System.Object](levelsNameCollector))			
		# 
		# groupBox4
		# 
		self._groupBox4.Controls.Add(self._textBox1)
		self._groupBox4.Controls.Add(self._label4)
		self._groupBox4.Location = System.Drawing.Point(12, 318)
		self._groupBox4.Name = "groupBox4"
		self._groupBox4.Size = System.Drawing.Size(449, 47)
		self._groupBox4.TabIndex = 7
		self._groupBox4.TabStop = False
		# 
		# label4
		# 
		self._label4.BackColor = System.Drawing.SystemColors.Info
		self._label4.BorderStyle = System.Windows.Forms.BorderStyle.Fixed3D
		self._label4.Font = System.Drawing.Font("MS UI Gothic", 9, System.Drawing.FontStyle.Bold, System.Drawing.GraphicsUnit.Point, 128)
		self._label4.ForeColor = System.Drawing.Color.Blue
		self._label4.Location = System.Drawing.Point(19, 12)
		self._label4.Name = "label4"
		self._label4.Size = System.Drawing.Size(142, 23)
		self._label4.TabIndex = 4
		self._label4.Text = "Diameter"
		# 
		# textBox1
		# 
		self._textBox1.Location = System.Drawing.Point(180, 12)
		self._textBox1.Name = "textBox1"
		self._textBox1.Size = System.Drawing.Size(263, 22)
		self._textBox1.TabIndex = 5
		# 
		# button3
		# 
		self._button3.BackColor = System.Drawing.SystemColors.ScrollBar
		self._button3.Cursor = System.Windows.Forms.Cursors.WaitCursor
		self._button3.Font = System.Drawing.Font("MS UI Gothic", 10, System.Drawing.FontStyle.Bold, System.Drawing.GraphicsUnit.Point, 128, True)
		self._button3.ForeColor = System.Drawing.Color.Red
		self._button3.Location = System.Drawing.Point(317, 395)
		self._button3.Name = "button3"
		self._button3.Size = System.Drawing.Size(49, 30)
		self._button3.TabIndex = 8
		self._button3.Text = "OK"
		self._button3.UseVisualStyleBackColor = False
		# 
		# button4
		# 
		self._button4.BackColor = System.Drawing.SystemColors.ScrollBar
		self._button4.Cursor = System.Windows.Forms.Cursors.WaitCursor
		self._button4.Font = System.Drawing.Font("MS UI Gothic", 10, System.Drawing.FontStyle.Bold, System.Drawing.GraphicsUnit.Point, 128, True)
		self._button4.ForeColor = System.Drawing.Color.Red
		self._button4.Location = System.Drawing.Point(372, 395)
		self._button4.Name = "button4"
		self._button4.Size = System.Drawing.Size(89, 30)
		self._button4.TabIndex = 8
		self._button4.Text = "CANCLE"
		self._button4.UseVisualStyleBackColor = False
		# 
		# label5
		# 
		self._label5.Location = System.Drawing.Point(1, 434)
		self._label5.Name = "label5"
		self._label5.Size = System.Drawing.Size(53, 19)
		self._label5.TabIndex = 9
		self._label5.Text = "@FVC"
		# 
		# MainForm
		# 
		self.ClientSize = System.Drawing.Size(482, 453)
		self.Controls.Add(self._label5)
		self.Controls.Add(self._button4)
		self.Controls.Add(self._button3)
		self.Controls.Add(self._groupBox4)
		self.Controls.Add(self._groupBox3)
		self.Controls.Add(self._groupBox2)
		self.Controls.Add(self._button2)
		self.Controls.Add(self._button1)
		self.Controls.Add(self._groupBox1)
		self.Name = "MainForm"
		self.Text = "PipeCreate"
		self._groupBox1.ResumeLayout(False)
		self._groupBox2.ResumeLayout(False)
		self._groupBox3.ResumeLayout(False)
		self._groupBox4.ResumeLayout(False)
		self._groupBox4.PerformLayout()
		self.ResumeLayout(False)


	def Label2Click(self, sender, e):
		pass


	def ComboBox1_SelectedIndexChanged(self, sender, e):
		TransactionManager.Instance.EnsureInTransaction(doc)



		TransactionManager.Instance.TransactionTaskDone()
		pass
	
	def ComboBox2_SelectedIndexChanged(self, sender, e):
		TransactionManager.Instance.EnsureInTransaction(doc)



		TransactionManager.Instance.TransactionTaskDone()
		pass	

	def ComboBox3_SelectedIndexChanged(self, sender, e):
		TransactionManager.Instance.EnsureInTransaction(doc)



		TransactionManager.Instance.TransactionTaskDone()
		pass


f = MainForm()
Application.Run(f)
# ----------------------------------------
pickPoints = Custom[pickPoints]()  # frozen; package Duynamo; from Duynamo. pick Point in current Workplane and retrive Revit Points in Millimeter unit
python_script_4 = Python()  # IronPython2; frozen; unwired: IN[0], IN[1]
# ---------- python_script_4.python (43 lines) ----------
"""Copyright by: vudinhduybm@gmail.com"""
import clr 
from System.Collections.Generic import *

clr.AddReference("ProtoGeometry")
from Autodesk.DesignScript.Geometry import *

clr.AddReference('RevitAPI')
from Autodesk.Revit.DB.Events import*

clr.AddReference('RevitAPIUI')
from Autodesk.Revit.UI import TaskDialog

clr.AddReference("RevitServices")
import RevitServices
from RevitServices.Persistence import DocumentManager

doc = DocumentManager.Instance.CurrentDBDocument
view = doc.ActiveView
uidoc = DocumentManager.Instance.CurrentUIApplication.ActiveUIDocument

x=True
dypoint = []
rpointM = []
rpointI = []
counter=0
msg = 'Pick Points on current Workplane in order, hit ESC when finished.'

TaskDialog.Show("Duynamo", msg)

while x == True:
	try:
		pt=uidoc.Selection.PickPoint(UnwrapElement(IN[0]))
		rpM=Point.ByCoordinates(pt.X*304.8,pt.Y*304.8,pt.Z*304.8)# don vi do mac dinh trong revitAPI la Inch, 1in=304.8mm
		rpI=Point.ByCoordinates(pt.X,pt.Y,pt.Z)
		counter=+1
		dypoint.append(pt)
		rpointM.append(rpM)
		rpointI.append(rpI)
	except:
		x=False

OUT=(dypoint,rpointM,rpointI)
# ----------------------------------------
boolean_3 = BoolSelector(true)
number = DoubleInput(500)
code_block = CodeBlock { "通気"; }
python_script_5 = Python(IN[0]=boolean_3, IN[1]=number, IN[2]=code_block)  # IronPython2
# ---------- python_script_5.python (64 lines) ----------
"""Copyright by: vudinhduybm@gmail.com"""
import clr 
import sys 
import System   
clr.AddReference("ProtoGeometry")
from Autodesk.DesignScript.Geometry import *

clr.AddReference("RevitAPI") 
from Autodesk.Revit.DB import*
from Autodesk.Revit.DB.Structure import*

clr.AddReference("RevitAPIUI") 
from Autodesk.Revit.UI import*

clr.AddReference("System") 
from System.Collections.Generic import List

clr.AddReference("RevitNodes")
import Revit
clr.ImportExtensions(Revit.Elements)
clr.ImportExtensions(Revit.GeometryConversion)

clr.AddReference("RevitServices")
import RevitServices
from RevitServices.Persistence import DocumentManager
from RevitServices.Transactions import TransactionManager

#Current doc/app/ui
doc = DocumentManager.Instance.CurrentDBDocument
uiapp = DocumentManager.Instance.CurrentUIApplication
app = uiapp.Application
uidoc = DocumentManager.Instance.CurrentUIApplication.ActiveUIDocument
view = doc.ActiveView

diameterIN = UnwrapElement(IN[1])
inSystemName = UnwrapElement(IN[2])

categories = [BuiltInCategory.OST_PipeCurves]
categoriesFilter = []
for c in categories:
    collector = FilteredElementCollector(doc).OfCategory(c).WhereElementIsNotElementType()
    categoriesFilter.append(collector)
flat_categoriesFilter = [item for sublist in categoriesFilter for item in sublist]
IDS = List[ElementId]()
for i in flat_categoriesFilter:
	IDS.Add(i.Id)

desPipes = []

paramFilter1 = ParameterValueProvider(ElementId(BuiltInParameter.RBS_PIPING_SYSTEM_TYPE_PARAM))
reason1 = FilterStringEquals()
fRule = FilterStringRule(paramFilter1,reason1, inSystemName)
filter1 = ElementParameterFilter(fRule)

i_Check = IN[1]/304.8
paramFilter2 = ParameterValueProvider(ElementId(BuiltInParameter.RBS_PIPE_DIAMETER_PARAM))
reason2 = FilterNumericEquals()
reason3 = FilterNumericGreaterOrEqual()
fRule2 = FilterDoubleRule(paramFilter2,reason2,i_Check,0.02)
filter2 = ElementParameterFilter(fRule2)
combineFilter = LogicalAndFilter(filter1 , filter2)
desPipes = FilteredElementCollector(doc, IDS).WherePasses(filter2).WhereElementIsNotElementType().ToElements()

OUT = desPipes
# ----------------------------------------
python_script_6 = Python()  # IronPython2; unwired: IN[0]
# ---------- python_script_6.python (46 lines) ----------
"""Copyright by: vudinhduybm@gmail.com"""
import clr 
import sys 
import System   
clr.AddReference("ProtoGeometry")
from Autodesk.DesignScript.Geometry import *

clr.AddReference("RevitAPI") 
from Autodesk.Revit.DB import*
from Autodesk.Revit.DB.Structure import*

clr.AddReference("RevitAPIUI") 
from Autodesk.Revit.UI import*

clr.AddReference("System") 
from System.Collections.Generic import List

clr.AddReference("RevitNodes")
import Revit
clr.ImportExtensions(Revit.Elements)
clr.ImportExtensions(Revit.GeometryConversion)

clr.AddReference("RevitServices")
import RevitServices
from RevitServices.Persistence import DocumentManager
from RevitServices.Transactions import TransactionManager

#Current doc/app/ui
doc = DocumentManager.Instance.CurrentDBDocument
uiapp = DocumentManager.Instance.CurrentUIApplication
app = uiapp.Application
uidoc = DocumentManager.Instance.CurrentUIApplication.ActiveUIDocument
view = doc.ActiveView

#Preparing input from dynamo to revit
element = UnwrapElement(IN[0])

#Do some action in a Transaction
TransactionManager.Instance.EnsureInTransaction(doc)
"""Now, You Can Code """



TransactionManager.Instance.TransactionTaskDone()

OUT = element
# ----------------------------------------
python_script_7 = Python()  # IronPython2; frozen; unwired: IN[0]
# ---------- python_script_7.python (47 lines) ----------
"""Copyright by: vudinhduybm@gmail.com"""
import clr 
import sys 
import System   
clr.AddReference("ProtoGeometry")
from Autodesk.DesignScript.Geometry import *

clr.AddReference("RevitAPI") 
from Autodesk.Revit.DB import*
from Autodesk.Revit.DB.Structure import*

clr.AddReference("RevitAPIUI") 
from Autodesk.Revit.UI import*

clr.AddReference("System") 
from System.Collections.Generic import List

clr.AddReference("RevitNodes")
import Revit
clr.ImportExtensions(Revit.Elements)
clr.ImportExtensions(Revit.GeometryConversion)

clr.AddReference("RevitServices")
import RevitServices
from RevitServices.Persistence import DocumentManager
from RevitServices.Transactions import TransactionManager

#Current doc/app/ui
doc = DocumentManager.Instance.CurrentDBDocument
uiapp = DocumentManager.Instance.CurrentUIApplication
app = uiapp.Application
uidoc = DocumentManager.Instance.CurrentUIApplication.ActiveUIDocument
view = doc.ActiveView

def getAllPipingSystems(doc):
	collector = FilteredElementCollector(doc).OfCategory(BuiltInCategory.OST_PipingSystem)
	pipingSystems = collector.ToElements()
	pipingSystemsName = []
	for system in pipingSystems:
		systemName = system.get_Parameter(BuiltInParameter.SYMBOL_NAME_PARAM).AsString()
		pipingSystemsName.append(systemName)
	return pipingSystemsName

lst = getAllPipingSystems(doc)
pipingSystemsCollector = [item for item in lst if item is not None]

OUT = pipingSystemsCollector
# ----------------------------------------
python_script_8 = Python()  # IronPython2; frozen; unwired: IN[0]
# ---------- python_script_8.python (371 lines) ----------
import clr
import sys 
import System   
clr.AddReference("ProtoGeometry")
from Autodesk.DesignScript.Geometry import *

clr.AddReference("RevitAPI") 
from Autodesk.Revit.DB import*
from Autodesk.Revit.DB.Structure import*

clr.AddReference("RevitAPIUI") 
from Autodesk.Revit.UI import*

clr.AddReference("System") 
from System.Collections.Generic import List

clr.AddReference("RevitNodes")
import Revit
clr.ImportExtensions(Revit.Elements)
clr.ImportExtensions(Revit.GeometryConversion)

clr.AddReference("RevitServices")
import RevitServices
from RevitServices.Persistence import DocumentManager
from RevitServices.Transactions import TransactionManager

clr.AddReference("System.Windows.Forms")
clr.AddReference("System.Drawing")
clr.AddReference("System.Windows.Forms.DataVisualization")

import System.Windows.Forms 
from System.Windows.Forms import *
import System.Drawing
from System.Drawing import *


doc = DocumentManager.Instance.CurrentDBDocument
uiapp = DocumentManager.Instance.CurrentUIApplication
app = uiapp.Application
uidoc = DocumentManager.Instance.CurrentUIApplication.ActiveUIDocument
view = doc.ActiveView



def getAllPipingSystems(doc):
	collector = FilteredElementCollector(doc, doc.ActiveView.Id).OfCategory(BuiltInCategory.OST_PipingSystem)
	pipingSystems = collector.ToElements()
	pipingSystemsName = []
	for system in pipingSystems:
		systemName = system.get_Parameter(BuiltInParameter.SYMBOL_NAME_PARAM).AsString()
		pipingSystemsName.append(systemName)
	return pipingSystemsName

pipingSystemsCollector = getAllPipingSystems(doc)



class MainForm(Form):
	def __init__(self):
		self.InitializeComponent()
	
	def InitializeComponent(self):
		self._groupBox1 = System.Windows.Forms.GroupBox()
		self._btt_getXY = System.Windows.Forms.Button()
		self._btt_getZ = System.Windows.Forms.Button()
		self._cbb_PipingSystemType = System.Windows.Forms.ComboBox()
		self._label1 = System.Windows.Forms.Label()
		self._groupBox2 = System.Windows.Forms.GroupBox()
		self._label2 = System.Windows.Forms.Label()
		self._cbb_PipeType = System.Windows.Forms.ComboBox()
		self._groupBox3 = System.Windows.Forms.GroupBox()
		self._label3 = System.Windows.Forms.Label()
		self._cbb_RefLevel = System.Windows.Forms.ComboBox()
		self._groupBox4 = System.Windows.Forms.GroupBox()
		self._label4 = System.Windows.Forms.Label()
		self._txb_Diameter = System.Windows.Forms.TextBox()
		self._btt_OK = System.Windows.Forms.Button()
		self._btt_CANCLE = System.Windows.Forms.Button()
		self._label5 = System.Windows.Forms.Label()
		self._groupBox5 = System.Windows.Forms.GroupBox()
		self._clb_XYValue = System.Windows.Forms.CheckedListBox()
		self._clb_ZValue = System.Windows.Forms.CheckedListBox()
		self._groupBox1.SuspendLayout()
		self._groupBox2.SuspendLayout()
		self._groupBox3.SuspendLayout()
		self._groupBox4.SuspendLayout()
		self._groupBox5.SuspendLayout()
		self.SuspendLayout()
		# 
		# groupBox1
		# 
		self._groupBox1.Controls.Add(self._label1)
		self._groupBox1.Controls.Add(self._cbb_PipingSystemType)
		self._groupBox1.Location = System.Drawing.Point(12, 174)
		self._groupBox1.Name = "groupBox1"
		self._groupBox1.Size = System.Drawing.Size(449, 47)
		self._groupBox1.TabIndex = 0
		self._groupBox1.TabStop = False
		# 
		# btt_getXY
		# 
		self._btt_getXY.BackColor = System.Drawing.SystemColors.Info
		self._btt_getXY.Font = System.Drawing.Font("MS UI Gothic", 10, System.Drawing.FontStyle.Bold, System.Drawing.GraphicsUnit.Point, 128, True)
		self._btt_getXY.ForeColor = System.Drawing.Color.Red
		self._btt_getXY.Location = System.Drawing.Point(52, 8)
		self._btt_getXY.Name = "btt_getXY"
		self._btt_getXY.Size = System.Drawing.Size(140, 30)
		self._btt_getXY.TabIndex = 1
		self._btt_getXY.Text = "get X,Y value"
		self._btt_getXY.UseVisualStyleBackColor = False
		self._btt_getXY.Click += self.Btt_getXYClick
		# 
		# btt_getZ
		# 
		self._btt_getZ.BackColor = System.Drawing.SystemColors.Info
		self._btt_getZ.Cursor = System.Windows.Forms.Cursors.AppStarting
		self._btt_getZ.Font = System.Drawing.Font("MS UI Gothic", 10, System.Drawing.FontStyle.Bold, System.Drawing.GraphicsUnit.Point, 128, True)
		self._btt_getZ.ForeColor = System.Drawing.Color.Red
		self._btt_getZ.Location = System.Drawing.Point(306, 8)
		self._btt_getZ.Name = "btt_getZ"
		self._btt_getZ.Size = System.Drawing.Size(140, 30)
		self._btt_getZ.TabIndex = 2
		self._btt_getZ.Text = "get Z value"
		self._btt_getZ.UseVisualStyleBackColor = False
		self._btt_getZ.Click += self.Btt_getZClick
		# 
		# cbb_PipingSystemType
		# 
		self._cbb_PipingSystemType.AllowDrop = True
		self._cbb_PipingSystemType.Cursor = System.Windows.Forms.Cursors.AppStarting
		self._cbb_PipingSystemType.FormattingEnabled = True
		self._cbb_PipingSystemType.Location = System.Drawing.Point(180, 12)
		self._cbb_PipingSystemType.Name = "cbb_PipingSystemType"
		self._cbb_PipingSystemType.Size = System.Drawing.Size(263, 23)
		self._cbb_PipingSystemType.TabIndex = 3
		self._cbb_PipingSystemType.SelectedIndexChanged += self.Cbb_PipingSystemTypeSelectedIndexChanged
		# 
		# label1
		# 
		self._label1.BackColor = System.Drawing.SystemColors.Info
		self._label1.BorderStyle = System.Windows.Forms.BorderStyle.Fixed3D
		self._label1.Font = System.Drawing.Font("MS UI Gothic", 9, System.Drawing.FontStyle.Bold, System.Drawing.GraphicsUnit.Point, 128)
		self._label1.ForeColor = System.Drawing.Color.Blue
		self._label1.Location = System.Drawing.Point(19, 12)
		self._label1.Name = "label1"
		self._label1.Size = System.Drawing.Size(142, 23)
		self._label1.TabIndex = 4
		self._label1.Text = "PipingSystemType"
		# 
		# groupBox2
		# 
		self._groupBox2.Controls.Add(self._label2)
		self._groupBox2.Controls.Add(self._cbb_PipeType)
		self._groupBox2.Location = System.Drawing.Point(12, 227)
		self._groupBox2.Name = "groupBox2"
		self._groupBox2.Size = System.Drawing.Size(449, 47)
		self._groupBox2.TabIndex = 5
		self._groupBox2.TabStop = False
		# 
		# label2
		# 
		self._label2.BackColor = System.Drawing.SystemColors.Info
		self._label2.BorderStyle = System.Windows.Forms.BorderStyle.Fixed3D
		self._label2.Font = System.Drawing.Font("MS UI Gothic", 9, System.Drawing.FontStyle.Bold, System.Drawing.GraphicsUnit.Point, 128)
		self._label2.ForeColor = System.Drawing.Color.Blue
		self._label2.Location = System.Drawing.Point(19, 12)
		self._label2.Name = "label2"
		self._label2.Size = System.Drawing.Size(142, 23)
		self._label2.TabIndex = 4
		self._label2.Text = "PipeType"
		# 
		# cbb_PipeType
		# 
		self._cbb_PipeType.AllowDrop = True
		self._cbb_PipeType.Cursor = System.Windows.Forms.Cursors.AppStarting
		self._cbb_PipeType.FormattingEnabled = True
		self._cbb_PipeType.Location = System.Drawing.Point(180, 12)
		self._cbb_PipeType.Name = "cbb_PipeType"
		self._cbb_PipeType.Size = System.Drawing.Size(263, 23)
		self._cbb_PipeType.TabIndex = 3
		self._cbb_PipeType.SelectedIndexChanged += self.Cbb_PipeTypeSelectedIndexChanged
		# 
		# groupBox3
		# 
		self._groupBox3.Controls.Add(self._label3)
		self._groupBox3.Controls.Add(self._cbb_RefLevel)
		self._groupBox3.Location = System.Drawing.Point(12, 280)
		self._groupBox3.Name = "groupBox3"
		self._groupBox3.Size = System.Drawing.Size(449, 47)
		self._groupBox3.TabIndex = 6
		self._groupBox3.TabStop = False
		# 
		# label3
		# 
		self._label3.BackColor = System.Drawing.SystemColors.Info
		self._label3.BorderStyle = System.Windows.Forms.BorderStyle.Fixed3D
		self._label3.Font = System.Drawing.Font("MS UI Gothic", 9, System.Drawing.FontStyle.Bold, System.Drawing.GraphicsUnit.Point, 128)
		self._label3.ForeColor = System.Drawing.Color.Blue
		self._label3.Location = System.Drawing.Point(19, 12)
		self._label3.Name = "label3"
		self._label3.Size = System.Drawing.Size(142, 23)
		self._label3.TabIndex = 4
		self._label3.Text = "RefLevel"
		# 
		# cbb_RefLevel
		# 
		self._cbb_RefLevel.AllowDrop = True
		self._cbb_RefLevel.Cursor = System.Windows.Forms.Cursors.AppStarting
		self._cbb_RefLevel.FormattingEnabled = True
		self._cbb_RefLevel.Location = System.Drawing.Point(180, 12)
		self._cbb_RefLevel.Name = "cbb_RefLevel"
		self._cbb_RefLevel.Size = System.Drawing.Size(263, 23)
		self._cbb_RefLevel.TabIndex = 3
		self._cbb_RefLevel.SelectedIndexChanged += self.Cbb_RefLevelSelectedIndexChanged
		# 
		# groupBox4
		# 
		self._groupBox4.Controls.Add(self._txb_Diameter)
		self._groupBox4.Controls.Add(self._label4)
		self._groupBox4.Location = System.Drawing.Point(12, 333)
		self._groupBox4.Name = "groupBox4"
		self._groupBox4.Size = System.Drawing.Size(449, 47)
		self._groupBox4.TabIndex = 7
		self._groupBox4.TabStop = False
		# 
		# label4
		# 
		self._label4.BackColor = System.Drawing.SystemColors.Info
		self._label4.BorderStyle = System.Windows.Forms.BorderStyle.Fixed3D
		self._label4.Font = System.Drawing.Font("MS UI Gothic", 9, System.Drawing.FontStyle.Bold, System.Drawing.GraphicsUnit.Point, 128)
		self._label4.ForeColor = System.Drawing.Color.Blue
		self._label4.Location = System.Drawing.Point(19, 12)
		self._label4.Name = "label4"
		self._label4.Size = System.Drawing.Size(142, 23)
		self._label4.TabIndex = 4
		self._label4.Text = "Diameter"
		# 
		# txb_Diameter
		# 
		self._txb_Diameter.Location = System.Drawing.Point(180, 12)
		self._txb_Diameter.Name = "txb_Diameter"
		self._txb_Diameter.Size = System.Drawing.Size(263, 22)
		self._txb_Diameter.TabIndex = 5
		self._txb_Diameter.TextChanged += self.Txb_DiameterTextChanged
		# 
		# btt_OK
		# 
		self._btt_OK.BackColor = System.Drawing.SystemColors.ScrollBar
		self._btt_OK.Cursor = System.Windows.Forms.Cursors.WaitCursor
		self._btt_OK.Font = System.Drawing.Font("MS UI Gothic", 10, System.Drawing.FontStyle.Bold, System.Drawing.GraphicsUnit.Point, 128, True)
		self._btt_OK.ForeColor = System.Drawing.Color.Red
		self._btt_OK.Location = System.Drawing.Point(317, 410)
		self._btt_OK.Name = "btt_OK"
		self._btt_OK.Size = System.Drawing.Size(49, 30)
		self._btt_OK.TabIndex = 8
		self._btt_OK.Text = "OK"
		self._btt_OK.UseVisualStyleBackColor = False
		self._btt_OK.Click += self.Btt_OKClick
		# 
		# btt_CANCLE
		# 
		self._btt_CANCLE.BackColor = System.Drawing.SystemColors.ScrollBar
		self._btt_CANCLE.Cursor = System.Windows.Forms.Cursors.WaitCursor
		self._btt_CANCLE.Font = System.Drawing.Font("MS UI Gothic", 10, System.Drawing.FontStyle.Bold, System.Drawing.GraphicsUnit.Point, 128, True)
		self._btt_CANCLE.ForeColor = System.Drawing.Color.Red
		self._btt_CANCLE.Location = System.Drawing.Point(372, 410)
		self._btt_CANCLE.Name = "btt_CANCLE"
		self._btt_CANCLE.Size = System.Drawing.Size(89, 30)
		self._btt_CANCLE.TabIndex = 8
		self._btt_CANCLE.Text = "CANCLE"
		self._btt_CANCLE.UseVisualStyleBackColor = False
		self._btt_CANCLE.Click += self.Btt_CANCLEClick
		# 
		# label5
		# 
		self._label5.Location = System.Drawing.Point(1, 434)
		self._label5.Name = "label5"
		self._label5.Size = System.Drawing.Size(53, 19)
		self._label5.TabIndex = 9
		self._label5.Text = "@FVC"
		# 
		# groupBox5
		# 
		self._groupBox5.Controls.Add(self._clb_ZValue)
		self._groupBox5.Controls.Add(self._clb_XYValue)
		self._groupBox5.Location = System.Drawing.Point(13, 44)
		self._groupBox5.Name = "groupBox5"
		self._groupBox5.Size = System.Drawing.Size(448, 124)
		self._groupBox5.TabIndex = 10
		self._groupBox5.TabStop = False
		# 
		# clb_XYValue
		# 
		self._clb_XYValue.AllowDrop = True
		self._clb_XYValue.CheckOnClick = True
		self._clb_XYValue.FormattingEnabled = True
		self._clb_XYValue.Location = System.Drawing.Point(0, 21)
		self._clb_XYValue.Name = "clb_XYValue"
		self._clb_XYValue.Size = System.Drawing.Size(264, 89)
		self._clb_XYValue.TabIndex = 0
		self._clb_XYValue.SelectedIndexChanged += self.Clb_XYValueSelectedIndexChanged
		# 
		# clb_ZValue
		# 
		self._clb_ZValue.AllowDrop = True
		self._clb_ZValue.CheckOnClick = True
		self._clb_ZValue.FormattingEnabled = True
		self._clb_ZValue.Location = System.Drawing.Point(282, 21)
		self._clb_ZValue.Name = "clb_ZValue"
		self._clb_ZValue.Size = System.Drawing.Size(166, 89)
		self._clb_ZValue.TabIndex = 1
		self._clb_ZValue.SelectedIndexChanged += self.Clb_ZValueSelectedIndexChanged
		# 
		# MainForm
		# 
		self.ClientSize = System.Drawing.Size(482, 453)
		self.Controls.Add(self._groupBox5)
		self.Controls.Add(self._label5)
		self.Controls.Add(self._btt_CANCLE)
		self.Controls.Add(self._btt_OK)
		self.Controls.Add(self._groupBox4)
		self.Controls.Add(self._groupBox3)
		self.Controls.Add(self._groupBox2)
		self.Controls.Add(self._btt_getZ)
		self.Controls.Add(self._btt_getXY)
		self.Controls.Add(self._groupBox1)
		self.Name = "MainForm"
		self.Text = "PipeCreate"
		self._groupBox1.ResumeLayout(False)
		self._groupBox2.ResumeLayout(False)
		self._groupBox3.ResumeLayout(False)
		self._groupBox4.ResumeLayout(False)
		self._groupBox4.PerformLayout()
		self._groupBox5.ResumeLayout(False)
		self.ResumeLayout(False)


	def Btt_getXYClick(self, sender, e):
		pass

	def Btt_getZClick(self, sender, e):
		pass


	def Cbb_PipingSystemTypeSelectedIndexChanged(self, sender, e):
		pass

	def Cbb_PipeTypeSelectedIndexChanged(self, sender, e):
		pass

	def Cbb_RefLevelSelectedIndexChanged(self, sender, e):
		pass

	def Txb_DiameterTextChanged(self, sender, e):
		pass

	def Btt_OKClick(self, sender, e):
		pass

	def Btt_CANCLEClick(self, sender, e):
		pass

	def Clb_XYValueSelectedIndexChanged(self, sender, e):
		pass

	def Clb_ZValueSelectedIndexChanged(self, sender, e):
		pass
	
	
f = MainForm()
Application.Run(f)
# ----------------------------------------
python_script_9 = Python()  # IronPython2; unwired: IN[0], IN[1]
# ---------- python_script_9.python (293 lines) ----------
import clr
import sys 
import System   
clr.AddReference("ProtoGeometry")
from Autodesk.DesignScript.Geometry import *

clr.AddReference("RevitAPI") 
from Autodesk.Revit.DB import*
from Autodesk.Revit.DB.Structure import*

clr.AddReference("RevitAPIUI") 
from Autodesk.Revit.UI import*

clr.AddReference("System") 
from System.Collections.Generic import List

clr.AddReference("RevitNodes")
import Revit
clr.ImportExtensions(Revit.Elements)
clr.ImportExtensions(Revit.GeometryConversion)

clr.AddReference("RevitServices")
import RevitServices
from RevitServices.Persistence import DocumentManager
from RevitServices.Transactions import TransactionManager

clr.AddReference("System.Windows.Forms")
clr.AddReference("System.Drawing")
clr.AddReference("System.Windows.Forms.DataVisualization")

import System.Windows.Forms 
from System.Windows.Forms import *
import System.Drawing
from System.Drawing import *
from System.Collections.Generic import*

import csv
import codecs

doc = DocumentManager.Instance.CurrentDBDocument
uiapp = DocumentManager.Instance.CurrentUIApplication
app = uiapp.Application
uidoc = DocumentManager.Instance.CurrentUIApplication.ActiveUIDocument
view = doc.ActiveView
sdkNumber = int(app.VersionNumber)

cateByName = UnwrapElement(Revit.Elements.Category.ByName("Schedules"))
bib = System.Enum.ToObject(BuiltInCategory, cateByName.Id.IntegerValue)
allSchedules = FilteredElementCollector(doc).OfCategory(bib).ToElements()

OUT = allSchedules



class MainForm(Form):
	def __init__(self):
		self.InitializeComponent()
	
	def InitializeComponent(self):
		# resources = System.Resources.ResourceManager("scheduleExport.MainForm", System.Reflection.Assembly.GetEntryAssembly())
		self._groupBox1 = System.Windows.Forms.GroupBox()
		self._groupBox2 = System.Windows.Forms.GroupBox()
		self._cbsSchedule = System.Windows.Forms.CheckedListBox()
		self._checkBoxAllNone = System.Windows.Forms.CheckBox()
		self._textBoxTotalItem = System.Windows.Forms.TextBox()
		self._label1 = System.Windows.Forms.Label()
		self._label2 = System.Windows.Forms.Label()
		self._textBoxBrowser = System.Windows.Forms.TextBox()
		self._bttBrowser = System.Windows.Forms.Button()
		self._bttExport = System.Windows.Forms.Button()
		self._bttCANCLE = System.Windows.Forms.Button()
		self._label3 = System.Windows.Forms.Label()
		self._groupBox1.SuspendLayout()
		self._groupBox2.SuspendLayout()
		self.SuspendLayout()
		# 
		# groupBox1
		# 
		self._groupBox1.BackgroundImageLayout = System.Windows.Forms.ImageLayout.None
		self._groupBox1.Controls.Add(self._cbsSchedule)
		self._groupBox1.Font = System.Drawing.Font("Meiryo UI", 8, System.Drawing.FontStyle.Regular, System.Drawing.GraphicsUnit.Point, 128)
		self._groupBox1.Location = System.Drawing.Point(17, 12)
		self._groupBox1.Name = "groupBox1"
		self._groupBox1.Size = System.Drawing.Size(350, 200)
		self._groupBox1.TabIndex = 0
		self._groupBox1.TabStop = False
		self._groupBox1.Text = "Schedule Table"
		# 
		# groupBox2
		# 
		self._groupBox2.BackgroundImageLayout = System.Windows.Forms.ImageLayout.None
		self._groupBox2.Controls.Add(self._bttBrowser)
		self._groupBox2.Controls.Add(self._textBoxBrowser)
		self._groupBox2.Controls.Add(self._label2)
		self._groupBox2.Font = System.Drawing.Font("Meiryo UI", 8)
		self._groupBox2.Location = System.Drawing.Point(30, 263)
		self._groupBox2.Name = "groupBox2"
		self._groupBox2.Size = System.Drawing.Size(350, 100)
		self._groupBox2.TabIndex = 1
		self._groupBox2.TabStop = False
		self._groupBox2.Text = "Export Options"
		# 
		# cbsSchedule
		# 
		self._cbsSchedule.CheckOnClick = True
		self._cbsSchedule.DisplayMember = "Name"
		self._cbsSchedule.AllowDrop = True
		self._cbsSchedule.Font = System.Drawing.Font("Meiryo UI", 8)
		self._cbsSchedule.FormattingEnabled = True
		self._cbsSchedule.Location = System.Drawing.Point(10, 33)
		self._cbsSchedule.Name = "cbsSchedule"
		self._cbsSchedule.Size = System.Drawing.Size(330, 156)
		self._cbsSchedule.TabIndex = 0
		self._cbsSchedule.SelectedIndexChanged += self.CbsScheduleSelectedIndexChanged
		for i in allSchedules:
			self._cbsSchedule.Items.Add(i)
		# 
		# checkBoxAllNone
		# 
		self._checkBoxAllNone.Font = System.Drawing.Font("Meiryo UI", 8)
		self._checkBoxAllNone.Location = System.Drawing.Point(17, 229)
		self._checkBoxAllNone.Name = "checkBoxAllNone"
		self._checkBoxAllNone.Size = System.Drawing.Size(135, 24)
		self._checkBoxAllNone.TabIndex = 2
		self._checkBoxAllNone.Text = "select All/None"
		self._checkBoxAllNone.UseVisualStyleBackColor = True
		self._checkBoxAllNone.CheckedChanged += self.CheckBoxAllNoneCheckedChanged
		# 
		# textBoxTotalItem
		# 
		self._textBoxTotalItem.Font = System.Drawing.Font("Meiryo UI", 8)
		self._textBoxTotalItem.Location = System.Drawing.Point(310, 229)
		self._textBoxTotalItem.Name = "textBoxTotalItem"
		self._textBoxTotalItem.Size = System.Drawing.Size(57, 24)
		self._textBoxTotalItem.TabIndex = 3
		self._textBoxTotalItem.TextChanged += self.TextBoxTotalItemTextChanged
		# 
		# label1
		# 
		self._label1.Font = System.Drawing.Font("Meiryo UI", 8)
		self._label1.Location = System.Drawing.Point(214, 232)
		self._label1.Name = "label1"
		self._label1.Size = System.Drawing.Size(91, 23)
		self._label1.TabIndex = 4
		self._label1.Text = "Total Items: "
		# 
		# label2
		# 
		self._label2.Font = System.Drawing.Font("Meiryo UI", 7)
		self._label2.Location = System.Drawing.Point(10, 29)
		self._label2.Name = "label2"
		self._label2.Size = System.Drawing.Size(125, 23)
		self._label2.TabIndex = 0
		self._label2.Text = "Output Folder"
		# 
		# textBoxBrowser
		# 
		self._textBoxBrowser.Location = System.Drawing.Point(10, 50)
		self._textBoxBrowser.Name = "textBoxBrowser"
		self._textBoxBrowser.Size = System.Drawing.Size(253, 24)
		self._textBoxBrowser.TabIndex = 1
		self._textBoxBrowser.TextChanged += self.TextBoxBrowserTextChanged
		# 
		# bttBrowser
		# 
		self._bttBrowser.BackColor = System.Drawing.Color.White
		self._bttBrowser.Font = System.Drawing.Font("Meiryo UI", 5)
		self._bttBrowser.Location = System.Drawing.Point(269, 50)
		self._bttBrowser.Name = "bttBrowser"
		self._bttBrowser.Size = System.Drawing.Size(75, 23)
		self._bttBrowser.TabIndex = 2
		self._bttBrowser.Text = "Browse"
		self._bttBrowser.UseVisualStyleBackColor = False
		self._bttBrowser.Click += self.BttBrowserClick
		# 
		# bttExport
		# 
		self._bttExport.Location = System.Drawing.Point(205, 381)
		self._bttExport.Name = "bttExport"
		self._bttExport.Size = System.Drawing.Size(75, 29)
		self._bttExport.TabIndex = 5
		self._bttExport.Text = "Export"
		self._bttExport.UseVisualStyleBackColor = True
		self._bttExport.Click += self.BttExportClick
		# 
		# bttCANCLE
		# 
		self._bttCANCLE.Location = System.Drawing.Point(284, 381)
		self._bttCANCLE.Name = "bttCANCLE"
		self._bttCANCLE.Size = System.Drawing.Size(83, 29)
		self._bttCANCLE.TabIndex = 6
		self._bttCANCLE.Text = "CANCLE"
		self._bttCANCLE.UseVisualStyleBackColor = True
		self._bttCANCLE.Click += self.BttCANCLEClick
		# 
		# label3
		# 
		self._label3.Font = System.Drawing.Font("Meiryo UI", 5, System.Drawing.FontStyle.Bold, System.Drawing.GraphicsUnit.Point, 128)
		self._label3.Location = System.Drawing.Point(5, 406)
		self._label3.Name = "label3"
		self._label3.Size = System.Drawing.Size(40, 14)
		self._label3.TabIndex = 7
		self._label3.Text = "@FVC"
		# 
		# MainForm
		# 
		self.BackColor = System.Drawing.SystemColors.ButtonHighlight
		self.ClientSize = System.Drawing.Size(382, 428)
		self.Controls.Add(self._label3)
		self.Controls.Add(self._bttCANCLE)
		self.Controls.Add(self._bttExport)
		self.Controls.Add(self._label1)
		self.Controls.Add(self._textBoxTotalItem)
		self.Controls.Add(self._checkBoxAllNone)
		self.Controls.Add(self._groupBox2)
		self.Controls.Add(self._groupBox1)
		self.Font = System.Drawing.Font("Meiryo UI", 9, System.Drawing.FontStyle.Regular, System.Drawing.GraphicsUnit.Point, 128)
		# self.Icon = resources.GetObject("$this.Icon")
		self.Name = "MainForm"
		self.Text = "scheduleExport"
		self._groupBox1.ResumeLayout(False)
		self._groupBox2.ResumeLayout(False)
		self._groupBox2.PerformLayout()
		self.ResumeLayout(False)
		self.PerformLayout()


	def CbsScheduleSelectedIndexChanged(self, sender, e):
		pass

	def CheckBoxAllNoneCheckedChanged(self, sender, e):
		var = self._cbsSchedule.Items.Count
		rangers = range(var)
		for i in rangers:
			if self._checkBoxAllNone.Checked == True:
				self._cbsSchedule.SetItemChecked(i, True)
				self._textBoxTotalItem.Text = str(var)
			else:
				self._cbsSchedule.SetItemChecked(i, False)
				self._textBoxTotalItem.Text = str(0)
		pass

	def TextBoxTotalItemTextChanged(self, sender, e):
		pass

	def TextBoxBrowserTextChanged(self, sender, e):
		pass

	def BttBrowserClick(self, sender, e):
		fileDialog = FolderBrowserDialog()
		fileDialog.ShowDialog()
		self._textBoxBrowser.Text  = fileDialog.SelectedPath
		pass

	def BttExportClick(self, sender, e):
		selected = []
		for i in self._cbsSchedule.CheckedItems:
			selected.append(i)
#_______________________________________________________________#
		# nameSched = []
		# for i in selected:
		# 	nameSched.append(i.Name + ".csv")
		path = self._textBoxBrowser.Text 
#_______________________________________________________________#
		self.outCSV = []
		n = 0
		for index, sched in enumerate(selected):
			schedules = UnwrapElement(sched)
			fileName = nameSched[index]
			try:
				for s in schedules:
					nameSched = s.Name + ".csv"

					export_Options = ViewScheduleExportOptions()
					schedules.Export(path,nameSched,export_Options)
					n += 1
					codec_reader = "utf-8" if sdkNumber > 2020 else "utf-16"
					with codecs.open(path, "rb", encoding = codec_reader) as csvfile:
						csv_reader = csv.reader(csvfile, delimiter=';')
					self.outCSV.append("Schedule Exported")

			except:
				self.outCSV.append("Export Failed")
		self.Close()

		pass

	def BttCANCLEClick(self, sender, e):
		self.Close()
		pass

f = MainForm()
Application.Run(f)
# ----------------------------------------
